# Grasshopper definition Config_Generator_Wallacei.gh (Grasshopper 1.0.7)
# Copyright: Job de Vogel
# plug-ins: Anemone, Wallacei

# ----
# 1. Postioning Towers
tower_1_x = Slider(-30, range=-42..-20)
tower_distance = Slider(48, range=0..75)
tower_2_pos = Slider(0.21, range=0..1)
tower_2_y = Slider(30, range=20..50)
tower_1_y = Slider(30, range=20..42)
tower_1_pos = Slider(0.64, range=0..1)
tower_2_x = Slider(-30, range=-50..-20)

circle = Circle(Plane=PlaneXY(0, 0, 0), Radius=tower_distance)
evaluate_curve = EvaluateCurve(Curve=reparameterize(circle), Parameter=tower_1_pos)  # -> Point, Tangent, Angle
evaluate_curve_2 = EvaluateCurve(Curve=reparameterize(circle), Parameter=tower_2_pos)  # -> Point, Tangent, Angle
negative = Negative(Value=tower_2_x)
negative_2 = Negative(Value=tower_2_y)

rectangle = Rectangle(Plane=evaluate_curve.Point, XSize=tower_1_x, YSize=tower_1_y, Radius=0)  # -> Rectangle, Length
rectangle_2 = Rectangle(Plane=evaluate_curve_2.Point, XSize=negative, YSize=negative_2, Radius=0)  # -> Rectangle, Length

area = Area(Geometry=rectangle_2.Rectangle)  # -> Area, Centroid
discontinuity = Discontinuity(Curve=rectangle_2.Rectangle, Level=1)  # -> Points, Parameters
area_2 = Area(Geometry=rectangle.Rectangle)  # -> Area, Centroid
unit_y = UnitY(Factor=1)
point_in_curve = PointInCurve(Point=discontinuity.Points, Curve=rectangle.Rectangle)  # -> Relationship, Point
vector_2pt = Vector2Pt(PointA=area_2.Centroid, PointB=area.Centroid, Unitize=False)  # -> Vector, Length
mass_addition = MassAddition(Input=point_in_curve.Relationship)  # -> Result, PartialResults
reverse = Reverse(Vector=vector_2pt.Vector)
angle = Angle(VectorA=unit_y, VectorB=vector_2pt.Vector)  # -> Angle, Reflex
angle_2 = Angle(VectorA=unit_y, VectorB=reverse)  # -> Angle, Reflex
larger_than = LargerThan(FirstNumber=mass_addition.Result, SecondNumber=0)  # -> LargerThan, OrEqualTo
line = Line(StartPoint=area_2.Centroid, EndPoint=area.Centroid)
degrees = Degrees(Radians=angle.Angle)
degrees_2 = Degrees(Radians=angle_2.Angle)
length = Length(Curve=line)
subtraction = Subtraction(A=degrees, B=45)
subtraction_2 = Subtraction(A=degrees_2, B=45)
one_over_x = OneOverX(Value=length)
absolute = Absolute(Value=subtraction)
absolute_2 = Absolute(Value=subtraction_2)
minimum = Minimum(A=absolute, B=absolute_2)
stream_filter = StreamFilter(Gate=larger_than.LargerThan, Stream0=0, Stream1=999999)
penalty_for_closeness = Panel(one_over_x)
intersection_pentalty = Panel(stream_filter)
penalty_closeness = Number(penalty_for_closeness)
penalty_diagonality = Number(intersection_pentalty)
top_width = Slider(0.85, range=0.8..1)
top_length = Slider(0.85, range=0.8..1)
upper_top_width = Slider(0.64, range=0.6..0.8)
upper_top_length = Slider(0.64, range=0.6..0.8)
length_factor_middle_rectangle = Slider(0.97, range=0.9..1)
width_factor_middle_rectangle = Slider(0.97, range=0.9..1)
height_tower_1 = Slider(119, range=90..120)
length_factor_top_rectangle = Slider(1.2, range=1..1.2)
width_factor_top_rectangle = Slider(1.2, range=1..1.2)
width_factor_middle_rectangle_2 = Slider(0.85, range=0.85..1)
width_factor_middle_rectangle_3 = Slider(0.85, range=0.85..1)
merge = Merge(Data1=rectangle.Rectangle, Data2=rectangle_2.Rectangle)
multiplication = Multiplication(A=height_tower_1, B=Slider(1.2, range=1.1..1.25))
list_item = ListItem(List=merge, Index=Slider(0, range=0..1), Wrap=True)  # -> Item, Item1
multiplication_2 = Multiplication(A=width_factor_middle_rectangle, B=upper_top_width)
multiplication_3 = Multiplication(A=length_factor_middle_rectangle, B=upper_top_length)
multiplication_4 = Multiplication(A=width_factor_top_rectangle, B=width_factor_middle_rectangle_3)
multiplication_5 = Multiplication(A=length_factor_top_rectangle, B=width_factor_middle_rectangle_2)
multiplication_6 = Multiplication(A=tower_2_x, B=width_factor_middle_rectangle)
multiplication_7 = Multiplication(A=tower_2_y, B=length_factor_middle_rectangle)
division = Division(A=multiplication, B=2)
multiplication_8 = Multiplication(A=tower_2_x, B=multiplication_2)
multiplication_9 = Multiplication(A=tower_2_y, B=multiplication_3)
multiplication_10 = Multiplication(A=tower_2_x, B=top_width)
multiplication_11 = Multiplication(A=tower_2_y, B=top_length)
curve = Curve(list_item.Item1)
curve_2 = Curve(list_item.Item)
multiplication_12 = Multiplication(A=tower_1_x, B=width_factor_top_rectangle)
multiplication_13 = Multiplication(A=tower_1_y, B=length_factor_top_rectangle)
division_2 = Division(A=height_tower_1, B=2)
multiplication_14 = Multiplication(A=tower_1_x, B=multiplication_4)
multiplication_15 = Multiplication(A=tower_1_y, B=multiplication_5)

# ----
# Constructing tower 1
discontinuity_2 = Discontinuity(Curve=curve_2, Level=1)  # -> Points, Parameters
rectangle_3 = Rectangle(curve_2)
list_item_2 = ListItem(List=discontinuity_2.Points, Index=1, Wrap=True)
unit_z = UnitZ(Factor=division_2)
unit_z_2 = UnitZ(Factor=height_tower_1)
move = Move(Geometry=list_item_2, Motion=unit_z)  # -> Geometry, Transform
move_2 = Move(Geometry=list_item_2, Motion=unit_z_2)  # -> Geometry, Transform
# 2. Build tower based on required volume
rectangle_4 = Rectangle(Plane=move_2.Geometry, XSize=multiplication_12, YSize=multiplication_13, Radius=0)  # -> Rectangle, Length
rectangle_5 = Rectangle(Plane=move.Geometry, XSize=multiplication_14, YSize=multiplication_15, Radius=0)  # -> Rectangle, Length
discontinuity_3 = Discontinuity(Curve=rectangle_5.Rectangle, Level=1)  # -> simplify(graft(Points)), Parameters
discontinuity_4 = Discontinuity(Curve=rectangle_4.Rectangle, Level=1)  # -> simplify(graft(Points)), Parameters
discontinuity_5 = Discontinuity(Curve=rectangle_3, Level=1)  # -> simplify(graft(Points)), Parameters
unit_z_3 = UnitZ(Factor=1)
interpolate_t = InterpolateT(
    Vertices=[discontinuity_5.Points, discontinuity_3.Points, discontinuity_4.Points],
    TangentStart=unit_z_3,
    TangentEnd=Vector(0, 0, 0),
    KnotStyle=1)  # -> flatten(Curve), Length, Domain
graft_tree = GraftTree(Tree=interpolate_t.Curve, IncludeEmptyLists=True, IncludeNullItems=True)
shift_list = ShiftList(List=interpolate_t.Curve, Shift=1, Wrap=True)  # -> graft(List)
area_3 = Area(Geometry=curve_2)  # -> Area, Centroid
shift_paths = ShiftPaths(Data=shift_list, Offset=1)
loft = Loft(
    Curves=[graft_tree, shift_paths],
    Options={Adjust=False, Closed=False, LoftEnds=0, LoftSimp=0, LoftType=0, Rebuild=10, Refit=0.01})  # -> flatten(Loft)
unit_z_4 = UnitZ(Factor=1)
number_slider = Slider(3, range=0..3)
brep_join = BrepJoin(Breps=loft)  # -> Breps, Closed
line_sdl = LineSDL(Start=area_3.Centroid, Direction=unit_z_4, Length=1)
cap_holes = CapHoles(Brep=brep_join.Breps)
multiplication_16 = Multiplication(A=number_slider, B=90)
rotate_axis = RotateAxis(Geometry=cap_holes, Angle=degrees(multiplication_16), Axis=line_sdl)  # -> Geometry, Transform

unit_z_5 = UnitZ(Factor=12)
unit_z_6 = UnitZ(Factor=12)
negative_3 = Negative(Value=unit_z_5)
rotate_axis_2 = RotateAxis(Geometry=curve_2, Angle=degrees(multiplication_16), Axis=line_sdl)  # -> Geometry, Transform
negative_4 = Negative(Value=unit_z_6)
extrude = Extrude(Base=rotate_axis_2.Geometry, Direction=negative_4)
area_4 = Area(Geometry=curve)  # -> Area, Centroid
cap_holes_2 = CapHoles(Brep=extrude)
number_slider_2 = Slider(1, range=0..3)
multiplication_17 = Multiplication(A=number_slider_2, B=90)
merge_2 = Merge(Data1=rotate_axis.Geometry, Data2=cap_holes_2)
volume = Volume(Geometry=rotate_axis.Geometry)  # -> Volume, Centroid
geometry = Geometry(simplify(merge_2))

# ---- group: Height circles
wlc = GenePool(Decimals=1, Maximum=0.6, Minimum=-0.6, Value=[-0.1, -0.5, -0.3, -0.4, 0.3, -0.2, -0.1])

# ----
max_radius_factor = Slider(2, range=0..10)

# ---- group: Radius circles
wlc_1 = GenePool(Decimals=2, Maximum=1, Minimum=0, Value=[0.98, 0.57, 0.68, 0.83, 0.97, 0.9, 0.91])

# ---- group: Parameter circles
wlc_3 = GenePool(Decimals=2, Maximum=1, Minimum=0, Value=[0.73, 0.02, 0.69, 0.05, 0.16, 0.47, 0.83])

# ----
requirements = Panel("""140722.5
68853
62509
53995.68
54418.5
23838
5000""")
construction = Slider(90000, range=0..100000)

# ---- group: Volume adjustment
wlc_4 = GenePool(Decimals=2, Maximum=1, Minimum=-1, Value=[0.66, 0.45, -0.85, 0.82, -0.31, 0.83, 0.96])

# ----
# 3. Configure functions in setup
entwine = Entwine(Branch00=wlc, Branch01=wlc_1, Branch02=wlc_3, Branch03=wlc_4, FlattenInputs=True)  # -> simplify(Result)
absolute_3 = Absolute(Value=wlc_4)

epw_url = Panel("https://energyplus-weather.s3.amazonaws.com/europe_wmo_region_6/NLD/NLD_Amsterdam.062400_IWEC/NLD_Amsterdam.062400_IWEC.zip")
# Retrieve the EPW data
# Double-click on False
go_to_epw_website = BooleanToggle(False)
epwmap = LBEPWmap(epw_map=go_to_epw_website)  # -> Output; plug-in component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
downloadepw = LBDownloadWeather(weather_URL=epw_url)  # -> epw_file, stat_file, ddy_file; plug-in component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

# ----
# Extract the EPW data
importepw = LBImportEPW(epw_file=downloadepw.epw_file)  # -> location, dry_bulb_temperature, dew_point_temperature, relative_humidity, wind_speed, wind_direction, direct_normal_rad, diffuse_horizontal_rad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; plug-in component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
month = Slider(7, range=0..10)
day = Slider(21, range=0..100)
hour = Slider(8, range=0..100)
month_2 = Slider(7, range=0..10)
day_2 = Slider(21, range=0..100)
hour_2 = Slider(21, range=0..100)

# ----
# Set the analysis period
month_3 = Slider(7, range=0..10)
day_3 = Slider(21, range=0..100)
hour_3 = Slider(15, range=0..23)
analysisperiod = LBAnalysisPeriod(start_month=month, start_day=day, start_hour=hour, end_month=month_2, end_day=day_2, end_hour=hour_2)  # -> period, hoys, dates; plug-in component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
hoy = LBCalculateHOY(month=month_3, day=day_3, hour=hour_3)  # -> flatten(hoy), flatten(doy), flatten(date); plug-in component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

# ----
# Change legend settings
# HERE -->
construct_domain = ConstructDomain(DomainStart=0, DomainEnd=1)
legend_steps = Slider(10, range=0..10)
range = Range(Domain=construct_domain, Steps=legend_steps)
# Set the legend color
gradient = Gradient(LowerLimit=0, UpperLimit=1, Parameter=range, stops=[0: RGB(0, 0, 0), 1: RGB(255, 255, 255)])
legend_size = Slider(30, range=0..10000)
location_legend = BooleanToggle(True)
legendpar = LBLegendParameters(colors=gradient, vert_or_horiz=location_legend, seg_height=legend_size)  # -> leg_par; plug-in component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

# ----
# Create the sunpath
sun_position = Slider(20, range=0..20)
scale = Panel("3")

sunpath_type = ValueList({"Orthographic", "Stereographic", "3D": None}, selected="3D")
sunpath = LBSunPath(north=sun_position, location=importepw.location, hoys=analysisperiod.hoys, scale=scale, projection=sunpath_type)  # -> out, vectors, altitudes, azimuths, hoys, sun_pts, analemma, daily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; plug-in component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

sphere = Sphere(Base=sunpath.sun_pts, Radius=1)
squareness = Panel("MINIMIZE NON-CUBENESS")

# ----
# Constructing tower 2
discontinuity_6 = Discontinuity(Curve=curve, Level=1)  # -> Points, Parameters
rectangle_6 = Rectangle(curve)
list_item_3 = ListItem(List=discontinuity_6.Points, Index=1, Wrap=True)
unit_z_7 = UnitZ(Factor=division_2)
unit_z_8 = UnitZ(Factor=multiplication)
unit_z_9 = UnitZ(Factor=height_tower_1)
move_3 = Move(Geometry=list_item_3, Motion=unit_z_9)  # -> Geometry, Transform
move_4 = Move(Geometry=list_item_3, Motion=unit_z_8)  # -> Geometry, Transform
move_5 = Move(Geometry=list_item_3, Motion=unit_z_7)  # -> Geometry, Transform
rectangle_7 = Rectangle(Plane=move_5.Geometry, XSize=multiplication_6, YSize=multiplication_7, Radius=0)  # -> Rectangle, Length
rectangle_8 = Rectangle(Plane=move_4.Geometry, XSize=multiplication_8, YSize=multiplication_9, Radius=0)  # -> Rectangle, Length
rectangle_9 = Rectangle(Plane=move_3.Geometry, XSize=multiplication_10, YSize=multiplication_11, Radius=0)  # -> Rectangle, Length
discontinuity_7 = Discontinuity(Curve=rectangle_7.Rectangle, Level=1)  # -> simplify(graft(Points)), Parameters
discontinuity_8 = Discontinuity(Curve=rectangle_9.Rectangle, Level=1)  # -> simplify(graft(Points)), Parameters
discontinuity_9 = Discontinuity(Curve=rectangle_8.Rectangle, Level=1)  # -> simplify(graft(Points)), Parameters
unit_z_10 = UnitZ(Factor=1)
unit_z_11 = UnitZ(Factor=1)
line_sdl_2 = LineSDL(Start=area_4.Centroid, Direction=unit_z_11, Length=1)

rotate_axis_3 = RotateAxis(Geometry=curve, Angle=degrees(multiplication_17), Axis=line_sdl_2)  # -> Geometry, Transform
extrude_2 = Extrude(Base=rotate_axis_3.Geometry, Direction=negative_3)
merge_3 = Merge(
    Data1=simplify(graft(discontinuity_6.Points)),
    Data2=discontinuity_7.Points,
    Data3=discontinuity_8.Points,
    Data4=discontinuity_9.Points)
cap_holes_3 = CapHoles(Brep=extrude_2)

interpolate_t_2 = InterpolateT(Vertices=merge_3, TangentStart=unit_z_10, TangentEnd=Vector(0, 0, 0), KnotStyle=1)  # -> flatten(Curve), Length, Domain
shift_list_2 = ShiftList(List=interpolate_t_2.Curve, Shift=1, Wrap=True)  # -> graft(List)
graft_tree_2 = GraftTree(Tree=interpolate_t_2.Curve, IncludeEmptyLists=True, IncludeNullItems=True)
shift_paths_2 = ShiftPaths(Data=shift_list_2, Offset=1)
loft_2 = Loft(
    Curves=[graft_tree_2, shift_paths_2],
    Options={Adjust=False, Closed=False, LoftEnds=0, LoftSimp=0, LoftType=0, Rebuild=10, Refit=0.01})  # -> flatten(Loft)
brep_join_2 = BrepJoin(Breps=loft_2)  # -> Breps, Closed
cap_holes_4 = CapHoles(Brep=brep_join_2.Breps)
rotate_axis_4 = RotateAxis(Geometry=cap_holes_4, Angle=degrees(multiplication_17), Axis=line_sdl_2)  # -> Geometry, Transform

merge_4 = Merge(Data1=rotate_axis_4.Geometry, Data2=cap_holes_3)
geometry_2 = Geometry(simplify(merge_4))
volume_2 = Volume(Geometry=rotate_axis_4.Geometry)  # -> Volume, Centroid
entwine_2 = Entwine(Branch00=geometry, Branch01=geometry_2, FlattenInputs=True)  # -> simplify(Result)
mass_addition_2 = MassAddition(Input=[volume_2.Volume, volume.Volume])  # -> Result, PartialResults

# ---- group: Extract facades
deconstruct_brep = DeconstructBrep(Brep=entwine_2)  # -> Faces, Edges, Vertices
area_5 = Area(Geometry=deconstruct_brep.Faces)  # -> Area, Centroid
deconstruct = Deconstruct(Point=area_5.Centroid)  # -> XComponent, YComponent, ZComponent
sort_list = SortList(Keys=deconstruct.ZComponent, ValuesValuesA=deconstruct_brep.Faces)  # -> Keys, ValuesValuesA
cull_index = CullIndex(List=sort_list.ValuesValuesA, Indices=[0, -1], Wrap=True)  # -> simplify(List)
shift_paths_3 = ShiftPaths(Data=cull_index, Offset=-1)

# ----
merge_5 = Merge(Data1=rotate_axis.Geometry, Data2=rotate_axis_4.Geometry)
panel = Panel(mass_addition_2.Result)
geometry_3 = Geometry(merge_5)

# ---- group: Extract facades / Facades to analyze
geometry_4 = Geometry(shift_paths_3)

# ---- group: Volume
mass_addition_3 = MassAddition(Input=requirements)  # -> Result, PartialResults
subtraction_3 = Subtraction(A=mass_addition_2.Result, B=mass_addition_3.Result)

# ----
subtraction_4 = Subtraction(A=subtraction_3, B=construction)
volume_difference = Absolute(Value=subtraction_4)
volume_difference_2 = Number(volume_difference)

# ----
# Surface to calculate
# Context geometry
surface = Surface(geometry_4)
geometry_5 = Geometry(<brep referenced from the Rhino model>)

multicore_processing = BooleanToggle(False)
run_the_calculation = BooleanToggle(True)
offset_height = Slider(1, range=0..1000)
grid_size = Panel("5")
# Calculate sun hours
directsunhours = LBDirectSunHours(
    vectors=flatten(sunpath.vectors),
    geometry=flatten(surface),
    context=flatten(geometry_5),
    grid_size=grid_size,
    offset_dist=offset_height,
    legend_par=legendpar,
    parallel=multicore_processing,
    run=run_the_calculation)  # -> out, points, results, mesh, legend, title, int_mtx; plug-in component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

point = Point(directsunhours.points)

# ---- group: Voxel Grid generator
bounding_box = BoundingBox(Content=geometry_3, Plane=PlaneXY(0, 0, 0), UnionBox=True)  # -> Box, Box_2
deconstruct_brep_2 = DeconstructBrep(Brep=bounding_box.Box_2)  # -> Faces, Edges, Vertices
deconstruct_box = DeconstructBox(Box=bounding_box.Box_2)  # -> Plane, X, Y, Z
list_item_4 = ListItem(List=deconstruct_brep_2.Vertices, Index=0, Wrap=True)
deconstruct_domain = DeconstructDomain(Domain=deconstruct_box.Y)  # -> Start, End
deconstruct_domain_2 = DeconstructDomain(Domain=deconstruct_box.X)  # -> Start, End
deconstruct_domain_3 = DeconstructDomain(Domain=deconstruct_box.Z)  # -> Start, End
number_slider_3 = Slider(15, range=0..40)
number_slider_4 = Slider(15, range=0..45)
subtraction_5 = Subtraction(A=deconstruct_domain.End, B=deconstruct_domain.Start)
subtraction_6 = Subtraction(A=deconstruct_domain_2.End, B=deconstruct_domain_2.Start)
subtraction_7 = Subtraction(A=deconstruct_domain_3.End, B=deconstruct_domain_3.Start)
division_3 = Division(A=subtraction_6, B=number_slider_3)
division_4 = Division(A=subtraction_7, B=number_slider_4)
division_5 = Division(A=subtraction_5, B=number_slider_3)
domain_box = DomainBox(Base=PlaneXY(0, 0, 0), X=division_3, Y=division_5, Z=division_4)
orient = Orient(Geometry=domain_box, Source=PlaneXY(0, 0, 0), Target=list_item_4)  # -> Geometry, Transform
box_array = BoxArray(Geometry=orient.Geometry, Cell=orient.Geometry, XCount=number_slider_3, YCount=number_slider_3, ZCount=number_slider_4)  # -> Geometry, Transform
volume_3 = Volume(Geometry=box_array.Geometry)  # -> Volume, Centroid
sort_list_2 = SortList(Keys=[division_3, division_5, division_4])  # -> reverse(Keys), ValuesValuesA
list_item_5 = ListItem(List=sort_list_2.Keys, Index=0, Wrap=True)
list_item_6 = ListItem(List=volume_3.Volume, Index=0, Wrap=True)

# ----
maximum = Maximum(A=subtraction_6, B=subtraction_5)
multiplication_18 = Multiplication(A=maximum, B=max_radius_factor)
point_in_breps = PointInBreps(Brep=geometry_3, Point=volume_3.Centroid, Strict=False)  # -> Inside, Index
multiplication_19 = Multiplication(A=wlc_1, B=multiplication_18)

# ---- group: Attractor
multiplication_20 = Multiplication(A=wlc, B=subtraction_7)
volume_4 = Volume(Geometry=bounding_box.Box_2)  # -> Volume, Centroid
unit_z_12 = UnitZ(Factor=multiplication_20)
move_6 = Move(Geometry=volume_4.Centroid, Motion=unit_z_12)  # -> Geometry, Transform
circle_2 = Circle(Plane=move_6.Geometry, Radius=multiplication_19)
evaluate_curve_3 = EvaluateCurve(Curve=reparameterize(circle_2), Parameter=wlc_3)  # -> Point, Tangent, Angle

# ---- group: Voxel Grid generator (continued)
cull_pattern = CullPattern(List=box_array.Geometry, CullPattern=point_in_breps.Inside)
cull_pattern_2 = CullPattern(List=volume_3.Centroid, CullPattern=point_in_breps.Inside)

# ----
voxels = Geometry(cull_pattern)
highest_nb_distance = Number(list_item_5)
block_volume = Number(list_item_6)
point_2 = Point(cull_pattern_2)
# Fab Lab Algen
# Data Center
# Hotel & Restaurant
# Residences
# Offices
# General Services
# Extra
points = Point(evaluate_curve_3.Point)
list_length = ListLength(List=points)

grid_volume = Number(block_volume)
division_6 = Division(A=requirements, B=grid_volume)
round = Round(Number=division_6)  # -> Nearest, Floor, Ceiling
number_slider_5 = Slider(0.1, range=0..1)
multiplication_21 = Multiplication(A=wlc_4, B=number_slider_5)
multiplication_22 = Multiplication(A=round.Ceiling, B=multiplication_21)
integer = Integer(multiplication_22)
mass_addition_4 = MassAddition(Input=absolute_3)  # -> Result, PartialResults
addition = Addition(A=round.Ceiling, B=integer)
minimize_deviation_volume = Panel(mass_addition_4.Result)

# ---- group: Main Assignment Loop
fast_loop_start = FastLoopStart(Iterations=list_length, Data=point_2)  # -> port, Counter, Data, Assigned
list_item_7 = ListItem(List=points, Index=fast_loop_start.Counter, Wrap=True)
list_item_8 = ListItem(List=addition, Index=fast_loop_start.Counter, Wrap=True)
clean_tree = CleanTree(RemoveNulls=True, RemoveInvalid=True, RemoveEmpty=False, Tree=fast_loop_start.Data)
closest_points = ClosestPoints(Point=list_item_7, Cloud=fast_loop_start.Data, Count=list_item_8)  # -> ClosestPoint, CPIndex, Distance
list_length_2 = ListLength(List=clean_tree)
merge_6 = Merge(Data1=fast_loop_start.Assigned, Data2=closest_points.CPIndex)  # -> flatten(Result)
smaller_than = SmallerThan(FirstNumber=list_length_2, SecondNumber=list_item_8)  # -> SmallerThan, OrEqualTo
replace_items = ReplaceItems(List=fast_loop_start.Data, Indices=closest_points.CPIndex, Wrap=False)
fast_loop_end = FastLoopEnd(
    port=fast_loop_start.port,
    Exit=smaller_than.SmallerThan,
    Data=replace_items,
    Assigned=simplify(merge_6),
    RecordData=False,
    TimeOutVal=0)  # -> Data, Assigned

# ---- group: Partition assigned boxes
mass_addition_5 = MassAddition(Input=addition)  # -> Result, PartialResults
cull_index_2 = CullIndex(List=fast_loop_end.Assigned, Indices=0, Wrap=True)
construct_domain_2 = ConstructDomain(DomainStart=0, DomainEnd=expr("x-1", mass_addition_5.Result))
sub_list = SubList(List=cull_index_2, Domain=construct_domain_2, Wrap=True)  # -> List, Index
partition_list = PartitionList(List=sub_list.List, Size=addition)  # -> simplify(Chunks)
index_clusters = Integer(partition_list)

# ---- group: Accepted volume
at_least = Slider(0.9, range=0..1)
multiplication_23 = Multiplication(A=round.Ceiling, B=at_least)
list_length_3 = ListLength(List=partition_list)  # -> simplify(Length)
graft_tree_3 = GraftTree(Tree=multiplication_23, IncludeEmptyLists=True, IncludeNullItems=True)  # -> simplify(Tree)
list_length_4 = ListLength(List=round.Ceiling)
amount_of_clusters = Integer(list_length_4)
larger_than_2 = LargerThan(FirstNumber=list_length_3, SecondNumber=graft_tree_3)  # -> LargerThan, OrEqualTo
acceptable_volume = Panel(larger_than_2.LargerThan)

# ----
# Fab Lab Algen
# Data Center
# Hotel & Restaurant
# Residences
# Offices
# General Services
# Extra
merge_7 = Merge(
    Data1=ColourSwatch(SwatchColor=RGBA(255, 255, 255, 40)),
    Data2=ColourSwatch(SwatchColor=RGBA(147, 191, 128, 124)),
    Data3=ColourSwatch(SwatchColor=RGBA(230, 129, 129, 19)),
    Data4=ColourSwatch(SwatchColor=RGBA(77, 150, 176, 32)),
    Data5=ColourSwatch(SwatchColor=RGBA(135, 77, 176, 32)),
    Data6=ColourSwatch(SwatchColor=RGBA(232, 156, 26, 32)),
    Data7=ColourSwatch(SwatchColor=RGBA(232, 26, 26, 32)))  # -> graft(Result)
list_item_9 = ListItem(List=cull_pattern, Index=index_clusters, Wrap=True)
volume_5 = Volume(Geometry=list_item_9)  # -> Volume, Centroid
mass_addition_6 = MassAddition(Input=volume_5.Volume)  # -> Result, PartialResults

# ---- group: Average Squareness Calculation
list_item_10 = ListItem(List=point_2, Index=index_clusters, Wrap=True)
tree_statistics = TreeStatistics(Tree=list_item_10)  # -> Paths, Length, Count
tree_branch = TreeBranch(Tree=list_item_10, Path=tree_statistics.Paths, MaintainPaths=True)
proximity_3d = Proximity3D(Points=tree_branch, Group=6, MinRadius=0, MaxRadius=expr("x+0.01", highest_nb_distance))  # -> Links, Topology

# ---- group: Labelling
list_item_11 = ListItem(List=point_2, Index=index_clusters, Wrap=True)
average = Average(Input=list_item_11)
panel_2 = Panel("""Fab Lab Algen
Data Center
Hotel & Restaurant
Residences
Offices
General Services
Extra""")
text_tag = TextTag(Location=average, Text=graft(panel_2), Colour=RGB(0, 0, 0))

# ----
list_item_12 = ListItem(List=point_2, Index=index_clusters, Wrap=True)
mesh_colours = MeshColours(Mesh=list_item_9, Colours=simplify(merge_7))
mesh_join = MeshJoin(Meshes=flatten(mesh_colours))
function_volumes = Panel(mass_addition_6.Result)

proximity_3d_2 = Proximity3D(Points=flatten(tree_branch), Group=6, MinRadius=0, MaxRadius=expr("x+0.01", highest_nb_distance))  # -> Links, Topology
list_length_5 = ListLength(List=proximity_3d_2.Links)  # -> flatten(Length)
average_2 = Average(Input=list_length_5)
# 4. Calculate Sunlight in with random position
# sun between -10 degrees north and 10 degrees
#  north.
squareness_2 = Panel("MAXIMIZE OVERALL CONNECTIONS")

list_length_6 = ListLength(List=proximity_3d.Links)
subtraction_8 = Subtraction(A=list_length_6, B=6)
squareness_penalty = Slider(3, range=0..10)
power = Power(A=subtraction_8, B=squareness_penalty)
absolute_4 = Absolute(Value=power)
shift_paths_4 = ShiftPaths(Data=absolute_4, Offset=-1)
mass_addition_7 = MassAddition(Input=shift_paths_4)  # -> Result, PartialResults
division_7 = Division(A=mass_addition_7.Result, B=graft(addition))  # -> flatten(Result)
average_3 = Average(Input=division_7)

connections = Data(average_2)
squareness_3 = Data(average_3)
# ASSIGNED POINTS IN CLUSTERING ALGORITHM
point_3 = Point(list_item_12)
closest_point = ClosestPoint(Point=point_3, Cloud=point)  # -> ClosestPoint, CPIndex, Distance
list_item_13 = ListItem(List=directsunhours.results, Index=closest_point.CPIndex, Wrap=True)
# Fab Lab Algen
# Data Center
# Hotel & Restaurant
# Residences
# Offices
# General Services
# Extra
mass_addition_8 = MassAddition(Input=list_item_13)  # -> simplify(Result), PartialResults
explode_tree = ExplodeTree(Data=mass_addition_8.Result)  # -> Branch0, Branch1, Branch2, Branch3, Branch4, Branch5, Branch6
all_functions_that_require_shadow_averag = Panel(mass_addition_8.Result)  # "All functions that require shadow, averaged"
one_over_x_2 = OneOverX(Value=explode_tree.Branch2)
one_over_x_3 = OneOverX(Value=explode_tree.Branch3)
one_over_x_4 = OneOverX(Value=explode_tree.Branch4)

shadow_fab_lab = Number(explode_tree.Branch0)
sun_hotel = Number(one_over_x_2)
sun_residences = Number(one_over_x_3)
sun_offices = Number(one_over_x_4)

wallacei_x = WallaceiX(
    Genes=[tower_distance, tower_1_pos, tower_2_pos, tower_1_x, tower_1_y, tower_2_x, tower_2_y, height_tower_1, number_slider, number_slider_2, wlc_1, wlc, wlc_3, wlc_4, sun_position],
    Objectives=[penalty_diagonality, penalty_closeness, volume_difference_2, connections, squareness_3, shadow_fab_lab, sun_hotel, sun_residences, sun_offices],
    Data=volume_difference_2,
    Phenotype=mesh_join,
    allFitness="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",
    allFrontIdx="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",
    allGenomes="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",
    curFrontIdx="30|0;30|1;30|2;30|3;30|4;30|5;30|6;30|7;30|8;30|9;30|10;30|11;30|12;30|13;30|14;30|15;30|16;30|17;30|18;30|19;30|20;30|21;30|22;30|23;30|24;30|25;30|26;30|27;30|28;30|29;30|30;30|31;30|32;30|33;30|34;30|35;30|36;30|37;30|38;30|39;30|40;30|41;30|42;30|43;30|44;30|45;30|46;30|47;30|48;30|49",
    curFrontIdxSave="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",
    popGen="50,100",
    total="1914391",
    wlcDone=True)  # -> WallaceiGenomes, FitnessValues, Data, Phenotypes

# ---- group: Generate Phenotype Grid
tree_statistics_2 = TreeStatistics(Tree=wallacei_x.Phenotypes)  # -> Paths, Length, Count
fitness_to_sort = Slider(1, range=0..2)
# 5. Wallacei optimization
tree_branch_2 = TreeBranch(Tree=wallacei_x.FitnessValues, Path=tree_statistics_2.Paths, MaintainPaths=True)
list_item_14 = ListItem(List=tree_branch_2, Index=fitness_to_sort, Wrap=True)  # -> Item, Item1, Item2
sort_list_3 = SortList(
    Keys=flatten(list_item_14.Item),
    ValuesValuesA=flatten(list_item_14.Item1),
    ValuesB=flatten(list_item_14.Item2),
    ValuesA=flatten(wallacei_x.Phenotypes))  # -> graft(Keys), graft(ValuesValuesA), graft(ValuesB), graft(ValuesA)
merge_8 = Merge(Data1=sort_list_3.Keys, Data2=sort_list_3.ValuesValuesA, Data3=sort_list_3.ValuesB)
x_size = Slider(300, range=0..1000)
y_size = Slider(300, range=0..1000)
# 6. Grid varying solutions
distribute_to_grid = DistributeToGrid(
    FitnessValues=merge_8,
    WallaceiPhenotypes=sort_list_3.ValuesA,
    SizeOfTheGridInTheXDirection=x_size,
    SizeOfTheGridInTheYDirection=y_size,
    OutputOptions=0)  # -> DistributedFitnessValues, DistributedData, DistributedGeometries, DistributedMeshes, DistributedNumbers, GridLocations

# ----
panel_3 = Panel(list_item_14.Item1)
