# Grasshopper definition Connectivity.gh (Grasshopper 1.0.7)
# Copyright: Job de Vogel
# plug-ins: LunchBox, Kangaroo Components

# ---- group: Building
point = Point([Point(-44, 0, 5), Point(-44, 0, 24), Point(-44, 0, 27.8), Point(-44, 0, 31.6), Point(-44, 0, 35.4), Point(-44, 0, 39.2), Point(-44, 0, 43), Point(-44, 0, 46.8), Point(-44, 0, 50.6), Point(-44, 0, 54.4)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])
number_slider = Slider(5, range=0..100)
sort_points = SortPoints(Points=point)  # -> Points, Indices
curve = Curve(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)
xy_plane = XYPlane(Origin=sort_points.Points)  # -> simplify(graft(Plane))
brep = Brep([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])
grid_structure = GridStructure(Surface=curve, UDivisions=number_slider, VDivisions=number_slider)  # -> StructureLines, StructureNodes
brep_plane = BrepPlane(Brep=brep, Plane=xy_plane)  # -> Curves, Points
project = Project(Geometry=grid_structure.StructureNodes, Plane=xy_plane)  # -> simplify(Geometry), Transform
clean_tree = CleanTree(RemoveNulls=True, RemoveInvalid=True, RemoveEmpty=True, Tree=brep_plane.Curves)
trim_tree = TrimTree(Tree=clean_tree, Depth=1)
point_in_breps = PointInBreps(Brep=brep, Point=project.Geometry, Strict=False)  # -> Inside, Index
length = Length(Curve=trim_tree)
cull_pattern = CullPattern(List=project.Geometry, CullPattern=point_in_breps.Inside)
graft_tree = GraftTree(Tree=trim_tree, IncludeEmptyLists=True, IncludeNullItems=True)
sort_list = SortList(Keys=length, ValuesValuesA=trim_tree)  # -> Keys, ValuesValuesA
tree_branch = TreeBranch(Path=Slider(0, range=0..100), MaintainPaths=True)
discontinuity = Discontinuity(Curve=graft_tree, Level=1)  # -> Points, Parameters
shatter = Shatter(Curve=graft(graft_tree), Parameters=discontinuity.Parameters)
trim_tree_2 = TrimTree(Tree=shatter, Depth=3)
removeduplicatelines = RemoveDuplicateLines(Lines=trim_tree_2, Tolerance=0.01)  # -> simplify(flatten(UniqueLines))
curve_2 = Curve(removeduplicatelines)
curve_middle = CurveMiddle(Curve=curve_2)
deconstruct = Deconstruct(Point=curve_middle)  # -> XComponent, YComponent, ZComponent
sort_list_2 = SortList(Keys=deconstruct.ZComponent, ValuesA=curve_2)  # -> Keys, ValuesA
create_set = CreateSet(List=sort_list_2.Keys)  # -> Set, Map
member_index = MemberIndex(Set=sort_list_2.Keys, Member=create_set.Set)  # -> Index, simplify(Count)
partition_list = PartitionList(List=sort_list_2.ValuesA, Size=member_index.Count)  # -> simplify(Chunks)
point_2 = Point(cull_pattern)
curve_3 = Curve(partition_list)

# ----
number_slider_2 = Slider(5, range=0..100)
curve_4 = Curve([<curve referenced from the Rhino model> x34])
curve_5 = Curve(<curve referenced from the Rhino model>)
grid_structure_2 = GridStructure(Surface=curve_5, UDivisions=number_slider_2, VDivisions=number_slider_2)  # -> StructureLines, StructureNodes
discontinuity_2 = Discontinuity(Curve=curve_4, Level=1)  # -> Points, Parameters
average = Average(Input=discontinuity_2.Points)  # -> flatten(ArithmeticMean)
brep_2 = Brep([<brep referenced from the Rhino model> x669])
xy_plane_2 = XYPlane(Origin=average)  # -> simplify(graft(Plane))
project_2 = Project(Geometry=grid_structure_2.StructureNodes, Plane=xy_plane_2)  # -> Geometry, Transform
brep_plane_2 = BrepPlane(Brep=brep_2, Plane=xy_plane_2)  # -> Curves, Points
point_in_curve = PointInCurve(Point=project_2.Geometry, Curve=graft(curve_4))  # -> Relationship, Point
trim_tree_3 = TrimTree(Tree=brep_plane_2.Curves, Depth=1)
larger_than = LargerThan(FirstNumber=point_in_curve.Relationship, SecondNumber=0)  # -> LargerThan, OrEqualTo
discontinuity_3 = Discontinuity(Curve=trim_tree_3, Level=1)  # -> Points, Parameters
graft_tree_2 = GraftTree(Tree=trim_tree_3, IncludeEmptyLists=True, IncludeNullItems=True)
average_2 = Average(Input=discontinuity_3.Points)
cull_pattern_2 = CullPattern(List=project_2.Geometry, CullPattern=larger_than.LargerThan)
discontinuity_4 = Discontinuity(Curve=graft_tree_2, Level=1)  # -> Points, Parameters
curve_6 = Curve(simplify(trim_tree_3))
point_3 = Point(simplify(average_2))
point_4 = Point(simplify(cull_pattern_2))
shatter_2 = Shatter(Curve=graft(graft_tree_2), Parameters=discontinuity_4.Parameters)
trim_tree_4 = TrimTree(Tree=shatter_2, Depth=3)
removeduplicatelines_2 = RemoveDuplicateLines(Lines=trim_tree_4, Tolerance=0.01)  # -> simplify(UniqueLines)
join_curves = JoinCurves(Curves=removeduplicatelines_2, Preserve=False)  # -> simplify(Curves)
curve_7 = Curve([<curve referenced from the Rhino model> x7])
point_5 = Point([<point referenced from the Rhino model> x400])
curve_middle_2 = CurveMiddle(Curve=curve_7)
deconstruct_2 = Deconstruct(Point=curve_middle_2)  # -> XComponent, YComponent, ZComponent
deconstruct_3 = Deconstruct(Point=point_5)  # -> XComponent, YComponent, ZComponent
sort_list_3 = SortList(Keys=deconstruct_2.ZComponent, ValuesValuesA=curve_7)  # -> Keys, ValuesValuesA
sort_list_4 = SortList(Keys=deconstruct_3.ZComponent, ValuesValuesA=point_5)  # -> Keys, ValuesValuesA
create_set_2 = CreateSet(List=sort_list_3.Keys)  # -> Set, Map
create_set_3 = CreateSet(List=sort_list_4.Keys)  # -> Set, Map
member_index_2 = MemberIndex(Set=sort_list_3.Keys, Member=create_set_2.Set)  # -> Index, simplify(Count)
member_index_3 = MemberIndex(Set=sort_list_4.Keys, Member=create_set_3.Set)  # -> Index, simplify(Count)
partition_list_2 = PartitionList(List=sort_list_3.ValuesValuesA, Size=member_index_2.Count)  # -> simplify(Chunks)
partition_list_3 = PartitionList(List=sort_list_4.ValuesValuesA, Size=member_index_3.Count)  # -> simplify(Chunks)
curve_8 = Curve(partition_list_2)
point_6 = Point(partition_list_3)
panel = Panel("C:\Users\Job de Vogel\OneDrive\Bureaublad\excel_test.xlsx")  # disabled
boolean_toggle = BooleanToggle(False)  # disabled
list_length = ListLength(List=point_6)
curve_9 = Curve(<curve referenced from the Rhino model>)
excel_reader = ExcelReader(ReadExcelData=boolean_toggle, WorkbookPath=panel, WorksheetName="Sheet1")  # -> Exceptions, ExcelData; disabled
list_length_2 = ListLength(List=curve_8)
graft_tree_3 = GraftTree(Tree=point_6, IncludeEmptyLists=True, IncludeNullItems=True)  # -> simplify(Tree)
duplicate_data = DuplicateData(Data=curve_8, Number=list_length, Order=True)
divide_length = DivideLength(Curve=curve_9, Length=Slider(3.8, range=0..10))  # -> Points, Tangents, Parameters
partition_list_4 = PartitionList(List=duplicate_data, Size=list_length_2)  # -> simplify(Chunks)
construct_domain = ConstructDomain(DomainStart=1, DomainEnd=49)  # disabled
data_recorder = DataRecorder(excel_reader.ExcelData, DataLimit=-10, RecordData=True)  # disabled
curve_closest_point = CurveClosestPoint(Point=graft_tree_3, Curve=partition_list_4)  # -> Point, Parameter, Distance
smaller_than = SmallerThan(FirstNumber=curve_closest_point.Distance, SecondNumber=0.1)  # -> SmallerThan, OrEqualTo
sub_list = SubList(List=data_recorder, Domain=construct_domain, Wrap=True)  # -> List, Index; disabled
explode_tree = ExplodeTree(Data=sub_list.List)  # -> Branch0, Branch1, Branch2, Branch3, Branch4, Branch5, Branch6; disabled
mass_addition = MassAddition(Input=smaller_than.SmallerThan)  # -> Result, PartialResults
text_split = TextSplit(Text=explode_tree.Branch1, Separators=",")  # disabled
text_split_2 = TextSplit(Text=explode_tree.Branch2, Separators=",")  # disabled
text_split_3 = TextSplit(Text=explode_tree.Branch3, Separators=",")  # disabled
multiplication = Multiplication(A=explode_tree.Branch0, B=24)  # disabled
text_split_4 = TextSplit(Text=explode_tree.Branch4, Separators=",")  # disabled
text_split_5 = TextSplit(Text=explode_tree.Branch5, Separators=";")  # disabled
boolean = Boolean(mass_addition.Result)
list_item = ListItem(List=point_6, Index=0, Wrap=True)  # -> Item, Item1
trim_tree_5 = TrimTree(Tree=boolean, Depth=1)
distance = Distance(PointA=list_item.Item, PointB=list_item.Item1)
text_split_6 = TextSplit(Text=text_split_5, Separators=",")  # disabled
cull_pattern_3 = CullPattern(List=point_6, CullPattern=invert(trim_tree_5))  # -> simplify(List)
number = Number(distance)
number_2 = Number(distance)
square = Square(Value=number)
square_2 = Square(Value=number_2)
xy_plane_3 = XYPlane(Origin=Point(0, 0, 0))
addition = Addition(A=square, B=square_2)
square_root = SquareRoot(Value=addition)
proximity_2d = Proximity2D(Points=cull_pattern_3, Plane=xy_plane_3, Group=Slider(8, range=0..10), MaxRadius=expr("x+0.001", square_root))  # -> simplify(Links), Topology
trim_tree_6 = TrimTree(Tree=proximity_2d.Links, Depth=1)
list_length_3 = ListLength(List=proximity_2d.Links)
list_length_4 = ListLength(List=trim_tree_6)
duplicate_data_2 = DuplicateData(Data=curve_8, Number=list_length_4, Order=True)
list_length_5 = ListLength(List=curve_8)
shift_paths = ShiftPaths(Data=list_length_3, Offset=-1)
graft_tree_4 = GraftTree(Tree=trim_tree_6, IncludeEmptyLists=True, IncludeNullItems=True)
partition_list_5 = PartitionList(List=duplicate_data_2, Size=list_length_5)  # -> simplify(Chunks)
curve_curve = CurveCurve(CurveA=graft_tree_4, CurveB=partition_list_5, UseTasks=False)  # -> Points, ParamsA, ParamsB
list_length_6 = ListLength(List=curve_curve.Points)
trim_tree_7 = TrimTree(Tree=list_length_6, Depth=1)
mass_addition_2 = MassAddition(Input=trim_tree_7)  # -> simplify(Result), PartialResults
larger_than_2 = LargerThan(FirstNumber=mass_addition_2.Result, SecondNumber=0)  # -> LargerThan, OrEqualTo
trim_tree_8 = TrimTree(Tree=larger_than_2.LargerThan, Depth=1)  # -> simplify(Tree)
partition_list_6 = PartitionList(List=trim_tree_8, Size=shift_paths)  # -> simplify(Chunks)
cull_pattern_4 = CullPattern(List=proximity_2d.Links, CullPattern=invert(partition_list_6))  # -> simplify(List)
cull_pattern_5 = CullPattern(List=proximity_2d.Topology, CullPattern=invert(partition_list_6))  # -> simplify(List)
point_7 = Point(cull_pattern_3)

# ---- group: Vertical Connections
point_8 = Point(point_7)
curve_10 = Curve(graft([<curve referenced from the Rhino model> x3]))
tree_statistics = TreeStatistics(Tree=curve_10)  # -> Paths, Length, Count
curve_closest_point_2 = CurveClosestPoint(Point=flatten(point_8), Curve=simplify(curve_10))  # -> Point, Parameter, Distance
list_length_7 = ListLength(List=point_8)  # -> flatten(Length)
duplicate_data_3 = DuplicateData(Data=flatten(point_8), Number=tree_statistics.Count, Order=True)
tree_statistics_2 = TreeStatistics(Tree=point_8)  # -> Paths, Length, Count
mass_addition_3 = MassAddition(Input=tree_statistics_2.Length)  # -> Result, PartialResults
partition_list_7 = PartitionList(List=curve_closest_point_2.Distance, Size=list_length_7)
panel_2 = Panel("""Per curve
per level""")
partition_list_8 = PartitionList(List=duplicate_data_3, Size=mass_addition_3.Result)  # -> simplify(Chunks)
list_length_8 = ListLength(List=partition_list_7)
series = Series(Start=0, Step=1, Count=list_length_8)  # -> simplify(Series)
partition_list_9 = PartitionList(List=partition_list_8, Size=tree_statistics_2.Length)  # -> simplify(Chunks)
sort_list_5 = SortList(Keys=partition_list_7, ValuesValuesA=series)  # -> Keys, ValuesValuesA
list_item_2 = ListItem(List=sort_list_5.Keys, Index=0, Wrap=True)
smaller_than_2 = SmallerThan(FirstNumber=list_item_2, SecondNumber=number)  # -> SmallerThan, OrEqualTo
list_item_3 = ListItem(List=sort_list_5.ValuesValuesA, Index=0, Wrap=True)
cull_pattern_6 = CullPattern(List=list_item_3, CullPattern=smaller_than_2.SmallerThan)
list_item_4 = ListItem(List=partition_list_9, Index=cull_pattern_6, Wrap=True)
trim_tree_9 = TrimTree(Tree=list_item_4, Depth=1)
panel_3 = Panel("Points")
panel_4 = Panel("Indices per level!")
trim_tree_10 = TrimTree(Tree=cull_pattern_6, Depth=1)
point_9 = Point(trim_tree_9)
integer = Integer(trim_tree_10)
polyline = PolyLine(Vertices=point_9, Closed=False)

# ----
length_2 = Length(Curve=cull_pattern_4)
custom_preview = CustomPreview(Geometry=cull_pattern_4, Material=ColourSwatch(SwatchColor=RGBA(255, 255, 255, 0)))

# ---- group: Neighbour Relations
ghpython_script = GhPythonScript(Indices=cull_pattern_5, Distances=length_2)  # -> simplify(parent_idxs), neighbour_dict; inputs Indices: tree, Distances: tree
# ---------- ghpython_script: Python ----------
"""Provides a scripting component.
    Inputs:
        Indices: Initial indices of the neighbours per point per floor
        Distances: Euclidian distances to neighbours
    Output:
        parent_idxs: Remapped indices of parent points
        neighbour_dict: Dictionary with all neighbour relations per parent"""

__author__ = "Job de Vogel"
__version__ = "2022.05.30"

from ghpythonlib import treehelpers
from Rhino.Geometry import Line
import random

indices = treehelpers.tree_to_list(Indices, False)
distances = treehelpers.tree_to_list(Distances, False)

parent_idxs = []
nb = {}

index_shift = 0
for f, (floor_idxs, floor_dis) in enumerate(zip(indices, distances)):
    parent_idxs.append([])
    nb[f] = {}
    for i, (neighbours, distance) in enumerate(zip(floor_idxs, floor_dis)):
        neighbours = [neighbor + index_shift for neighbor in neighbours]
        
        parent_idxs[f].append(i + index_shift)

        nb[f][i + index_shift] = dict(zip(neighbours, distance))
    
    index_shift += len(indices[f])

parent_idxs = treehelpers.list_to_tree(parent_idxs)
neighbour_dict = list(nb.values())
print(neighbour_dict[0])
# ---------- end ghpython_script ----------

# ----
flatten_tree = FlattenTree(Tree=point_7, Path="{0}")
suirify = Suirify(ghpython_script.neighbour_dict)
point_10 = Point([<point referenced from the Rhino model> x2])
point_11 = Point(<point referenced from the Rhino model>)
point_12 = Point(<point referenced from the Rhino model>)
point_13 = Point([<point referenced from the Rhino model> x3])
integer_2 = Integer(flatten(ghpython_script.parent_idxs))
entwine = Entwine(Branch00=point_12, Branch01=point_13, FlattenInputs=True)
entwine_2 = Entwine(Branch00=point_10, Branch01=point_11, FlattenInputs=True)
duplicate_data_4 = DuplicateData(Data=flatten(integer_2), Number=tree_statistics.Count, Order=True)
closest_point = ClosestPoint(Point=entwine, Cloud=flatten_tree)  # -> ClosestPoint, CPIndex, Distance
closest_point_2 = ClosestPoint(Point=entwine_2, Cloud=flatten_tree)  # -> ClosestPoint, CPIndex, Distance
partition_list_10 = PartitionList(List=duplicate_data_4, Size=mass_addition_3.Result)  # -> simplify(Chunks)
longest_list = LongestList(ListListA=closest_point_2.CPIndex, ListListB=closest_point.CPIndex, PaddingMode=2)  # -> flatten(ListListA), flatten(ListListB)
partition_list_11 = PartitionList(List=partition_list_10, Size=tree_statistics_2.Length)  # -> simplify(Chunks)
manhattandistance = BooleanToggle(False)
list_length_9 = ListLength(List=flatten_tree)
parallel = BooleanToggle(True)
series_2 = Series(Start=0, Step=1, Count=10)
list_item_5 = ListItem(List=partition_list_11, Index=cull_pattern_6, Wrap=True)
trim_tree_11 = TrimTree(Tree=list_item_5, Depth=1)
flatten_tree_2 = FlattenTree(Tree=ghpython_script.parent_idxs, Path="{0}")
panel_5 = Panel("""Real indices!
Per curve""")
integer_3 = Integer(trim_tree_11)
# Elevator cost not implemented yet. May be interesting for stairs.
ghpython_script_2 = GhPythonScript(neighbour_dict=suirify, vertical_connections=integer_3)  # -> building_neighbours; inputs neighbour_dict: list, vertical_connections: tree
# ---------- ghpython_script_2: Python ----------
__author__ = "Job de Vogel"
__version__ = "2022.05.31"
        
from ghpythonlib import treehelpers as th
import itertools
        
#print(neighbour_dict[0][47])
        
building_dict = {}
        
for dict in neighbour_dict:
    building_dict.update(dict)
        
#print(building_dict[47])
#  {36: 7.8567420131838537, 37: 5.55555555555555, 38: 7.8567420131838581, 46: 5.55555555555555, 48: 5.5555555555555571}
""" """
        
vertical_connections = th.tree_to_list(vertical_connections, False)
        
for vertical in vertical_connections:
    for i in vertical:
        temp_neighbours = vertical[:]
        temp_neighbours.remove(i)
        
        temp_dict = {}
        for neigh in temp_neighbours:
            temp_dict[neigh] = 0
        
        building_dict[i] = {k:v for d in (building_dict[i],temp_dict) for k,v in d.items()}

# Convert Building Dict to Grasshopper output
temp = {}
temp[0] = building_dict

building_neighbours = list(temp.values())
# ---------- end ghpython_script_2 ----------
astar_algorithm_fast = GhPythonScript(
    StartIndex=longest_list.ListListA,
    GoalIndex=longest_list.ListListB,
    points=flatten_tree,
    parent_idxs=flatten(ghpython_script.parent_idxs),
    neighbour_dict=ghpython_script_2,
    cloud_size=list_length_9,
    manhattanDistance=manhattandistance,
    Parallel=parallel)  # -> result; inputs StartIndex: list of Int32, GoalIndex: list of Int32, points: list of Point3d, parent_idxs: list, cloud_size: Int32, Cull_Data: list of Int32, manhattanDistance: Boolean, Parallel: Boolean
# ---------- astar_algorithm_fast: Python ----------
__author__copy = "Job de Vogel"
__version__ = "2020.11.06"
# Updated on 2022.05.31

from math import sqrt
import array as array
import random

def manhattan(index_1, index_2):
    point_1_coord = points[index_1]
    point_2_coord = points[index_2]
    
    return sum(abs(val1-val2) for val1, val2 in zip(point_1_coord, point_2_coord))

def euclidean(index_1, index_2):
    point_1_coord = points[index_1]
    point_2_coord = points[index_2]
    
    squares = [(p-q) ** 2 for p, q in zip(point_1_coord, point_2_coord)]
    return sum(squares) ** .5

def astar(Start, Goal, manhattanDistance = True):
    ###variables:
    open_set = []
    open_set.append((0, Start))
    came_from = {}
    path = array.array('i', [])

    g_score = {index: float("inf") for index in range(cloud_size)}
    g_score[Start] = 0

    f_score = {index: float("inf") for index in range(cloud_size)}
    
    
    if manhattanDistance:
        f_score[Start] = manhattan(Start, Goal)
    else:
        f_score[Start] = euclidean(Start, Goal)

    closed_set = {Start}

    iterations = 1

    #Algorithm function:
    while open_set:
        current = open_set[0][1]
        closed_set.remove(current)

        if current == Goal:
            #rebuild the path:
            while current != Start:
                    try:
                        path.insert(0, current)
                        current = came_from[current]
                    except KeyError:
                        path = False
                        break
            path.insert(0, Start)
            break

        #f_score_temp stores the f_scores of the neighbors of this node, so that it can be shuffled before it is added to the open_set
        f_score_temp = []

        Neighbors = neighbour_dict[current]

        #Calculate f_score for all neighbors
        for neighbor in Neighbors:
            temp_g_score = g_score[current] + Neighbors[neighbor]
            if temp_g_score < g_score[neighbor]:
                came_from[neighbor] = current
                g_score[neighbor] = temp_g_score
                
                if manhattanDistance:
                    f_score[neighbor] = temp_g_score + manhattan(neighbor, Goal)
                else:
                    f_score[neighbor] = temp_g_score + euclidean(neighbor, Goal) 

                if neighbor not in closed_set:
                    f_score_temp.append((f_score[neighbor], neighbor))
                    closed_set.add(neighbor)

        #shuffle the neighors and their f_scores (this will give alternative paths)
        if not Parallel:
            random.seed(random.random())
        random.shuffle(f_score_temp)
       
        open_set = open_set + f_score_temp
        
        #sort open_set based on f_score
        open_set.pop(0)
        open_set = sorted(open_set, key = lambda f: f[0])
        iterations += 1
    return path

def main(i):
    #Check if there are multiple starts/goals, if not use a single value
    if len(StartIndex) > 1:
        Start = StartIndex[i]
    else:
        Start = StartIndex[0]

    if len(GoalIndex) > 1:
        Goal = GoalIndex[i]
    else:
        Goal = GoalIndex[0]
    
    #In fast version of Astar, Start automatically gets added withoud checking Cull_Data, therefore do it manually here
    if Start in Cull_Data:
        Start = None

    #If goal isn't checked in Cull_Data, it is calculated, while a path is not possible
    if Goal in Cull_Data:
        Goal = None

    #Try to find a path, if not possible, return empty list
    try:
        path = astar(Start, Goal, manhattanDistance)
    except:
        path = None
    return path

##Find the number of paths to find
number_of_paths = [j for j in range(max(len(StartIndex), len(GoalIndex)))]

import ghpythonlib.parallel as parallel
import ghpythonlib.treehelpers as th

##ADD A NON-PARALLEL OPTION HERE
if Parallel == True:
    result = th.list_to_tree(parallel.run(main, number_of_paths, False))
else:
    result = []
    for i in number_of_paths:
        result.append(main(i))
    result = th.list_to_tree(result)
# ---------- end astar_algorithm_fast ----------
panel_6 = Panel(astar_algorithm_fast)
list_item_6 = ListItem(List=flatten(point_7), Index=astar_algorithm_fast, Wrap=True)  # -> simplify(Item)
member_index_4 = MemberIndex(Set=flatten(astar_algorithm_fast), Member=flatten(flatten_tree_2))  # -> flatten(Index), Count
random = Random(Range=Domain(0, 255), Number=90, Seed=Slider(1, range=0..3))
polyline_2 = PolyLine(Vertices=list_item_6, Closed=False)
panel_7 = Panel(member_index_4.Index)
partition_list_12 = PartitionList(List=random, Size=3)
end_points = EndPoints(Curve=polyline_2)  # -> Start, End
list_item_7 = ListItem(List=partition_list_12, Index=0, Wrap=True)  # -> Item, Item1, Item2
pipe = Pipe(Curve=polyline_2, Radius=0.4, Caps=0)  # -> simplify(Pipe)
colour_rgb = ColourRGB(Alpha=255, Red=list_item_7.Item, Green=list_item_7.Item1, Blue=list_item_7.Item2)  # -> simplify(Colour)
custom_preview_2 = CustomPreview(Geometry=[end_points.Start, end_points.End, pipe], Material=colour_rgb)
