# Grasshopper definition Facade.gh (Grasshopper 1.0.7)
# plug-ins: LunchBox

# Internalised example. Make sure the tower
# facade is one geometry and placed in the origin
# of the Rhino World view. Both the top and bottom
# rectangle of the facade loft should be connected
# to the z-axis.
geometry = Geometry(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)

# ---- group: Generate Rectangles around facade surfaces
deconstruct_brep = DeconstructBrep(Brep=geometry)  # -> Faces, Edges, Vertices
deconstruct_brep_2 = DeconstructBrep(Brep=deconstruct_brep.Faces)  # -> Faces, Edges, Vertices
evaluate_surface = EvaluateSurface(Surface=reparameterize(deconstruct_brep.Faces), Point="0.5,0.5")  # -> Point, simplify(graft(Normal)), UDirection, VDirection, Frame
brep_edges = BrepEdges(Brep=deconstruct_brep_2.Faces)  # -> Naked, Interior, NonManifold
amplitude = Amplitude(Vector=evaluate_surface.Normal, Amplitude=10)
join_curves = JoinCurves(Curves=brep_edges.Naked, Preserve=False)
vector_display = VectorDisplay(Anchor=graft(evaluate_surface.Point), Vector=amplitude)
unit_x = UnitX(Factor=1)
surface = Surface(simplify(graft(deconstruct_brep.Faces)))
vector = Vector(evaluate_surface.Normal)
align_plane = AlignPlane(Plane=evaluate_surface.Frame, Direction=unit_x)  # -> Plane, Angle
unit_z = UnitZ(Factor=1)
discontinuity = Discontinuity(Curve=join_curves, Level=1)  # -> Points, Parameters
align_plane_2 = AlignPlane(Plane=align_plane.Plane, Direction=unit_z)  # -> Plane, Angle
bounding_box = BoundingBox(Content=surface, Plane=graft(align_plane_2.Plane))  # -> Box, Box_2
deconstruct_box = DeconstructBox(Box=bounding_box.Box)  # -> Plane, X, Y, Z
rectangle = Rectangle(Plane=deconstruct_box.Plane, XSize=deconstruct_box.X, YSize=deconstruct_box.Y, Radius=0)  # -> Rectangle, Length

# ---- group: Get tower height
bounding_box_2 = BoundingBox(Content=geometry, Plane=PlaneXY(0, 0, 0))  # -> Box, Box_2
deconstruct_box_2 = DeconstructBox(Box=bounding_box_2.Box)  # -> Plane, X, Y, Z
deconstruct_domain = DeconstructDomain(Domain=deconstruct_box_2.Z)  # -> Start, End

# ---- group: Generate triangular and straight panels / Generate panels
deconstruct_domain_2 = DeconstructDomain(Domain=deconstruct_box.Y)  # -> Start, End
absolute = Absolute(Value=deconstruct_domain_2.End)
absolute_2 = Absolute(Value=deconstruct_domain_2.Start)
u_panel_width = Slider(1.2, range=0..10)
v_panel_height = Slider(3.8, range=0..10)
addition = Addition(A=absolute_2, B=absolute)  # -> simplify(Result)
division = Division(A=deconstruct_domain.End, B=v_panel_height)
division_2 = Division(A=addition, B=u_panel_width)
quad_panels = QuadPanels(Surface=rectangle.Rectangle, UDivisions=division, VDivisions=division_2)

# ---- group: Generate triangular and straight panels
curve = Curve(join_curves)
discontinuity_2 = Discontinuity(Curve=curve, Level=1)  # -> Points, Parameters
shatter = Shatter(Curve=curve, Parameters=discontinuity_2.Parameters)
end_points = EndPoints(Curve=shatter)  # -> Start, End
deconstruct = Deconstruct(Point=end_points.End)  # -> XComponent, YComponent, ZComponent
deconstruct_2 = Deconstruct(Point=end_points.Start)  # -> XComponent, YComponent, ZComponent
subtraction = Subtraction(A=deconstruct_2.XComponent, B=deconstruct.XComponent)
subtraction_2 = Subtraction(A=deconstruct_2.YComponent, B=deconstruct.YComponent)
subtraction_3 = Subtraction(A=deconstruct_2.ZComponent, B=deconstruct.ZComponent)
area = Area(Geometry=quad_panels, UseTasks=True)  # -> Area, Centroid
absolute_3 = Absolute(Value=subtraction)
absolute_4 = Absolute(Value=subtraction_2)
absolute_5 = Absolute(Value=subtraction_3)
larger_than = LargerThan(FirstNumber=absolute_3, SecondNumber=0)  # -> LargerThan, OrEqualTo
larger_than_2 = LargerThan(FirstNumber=absolute_4, SecondNumber=0)  # -> LargerThan, OrEqualTo
larger_than_3 = LargerThan(FirstNumber=absolute_5, SecondNumber=0)  # -> LargerThan, OrEqualTo
gate_or = GateOr(A=larger_than.LargerThan, B=larger_than_2.LargerThan)
gate_and = GateAnd(A=gate_or, B=larger_than_3.LargerThan)
cull_pattern = CullPattern(List=shatter, CullPattern=gate_and)  # -> simplify(graft(List))
# Only use in case of unexpected results
tolerance = Slider(0.6, range=0..10)
curve_closest_point = CurveClosestPoint(Point=simplify(area.Centroid), Curve=simplify(cull_pattern))  # -> Point, Parameter, Distance
panel = Panel("""{0;0}
{1;0}
{2;0}
{3;1}""")
smaller_than = SmallerThan(FirstNumber=curve_closest_point.Distance, SecondNumber=tolerance)  # -> SmallerThan, OrEqualTo
tree_branch = TreeBranch(Tree=smaller_than.SmallerThan, Path=panel, MaintainPaths=False)

# ---- group: Cut and organize panels
dispatch = Dispatch(List=simplify(quad_panels), DispatchPattern=simplify(tree_branch))  # -> simplify(ListA), simplify(ListB)
dispatch_2 = Dispatch(List=simplify(area.Centroid), DispatchPattern=simplify(tree_branch))  # -> simplify(ListA), simplify(ListB)
deconstruct_3 = Deconstruct(Point=dispatch_2.ListB)  # -> XComponent, YComponent, ZComponent
deconstruct_4 = Deconstruct(Point=dispatch_2.ListA)  # -> XComponent, YComponent, ZComponent
surface_split = SurfaceSplit(Surface=simplify(dispatch.ListA), Curves=simplify(curve))
create_set = CreateSet(List=deconstruct_3.ZComponent)  # -> Set, Map
create_set_2 = CreateSet(List=deconstruct_4.ZComponent)  # -> Set, Map
list_item = ListItem(List=surface_split, Index=0, Wrap=True)
member_index = MemberIndex(Set=deconstruct_4.ZComponent, Member=create_set_2.Set)  # -> Index, simplify(Count)
member_index_2 = MemberIndex(Set=deconstruct_3.ZComponent, Member=create_set.Set)  # -> Index, simplify(Count)
trim_tree = TrimTree(Tree=list_item, Depth=1)
partition_list = PartitionList(List=dispatch.ListB, Size=member_index_2.Count)
partition_list_2 = PartitionList(List=dispatch_2.ListB, Size=member_index_2.Count)
partition_list_3 = PartitionList(List=dispatch_2.ListA, Size=member_index.Count)
flip_matrix = FlipMatrix(Data=trim_tree)
path_mapper = PathMapper(partition_list, source="{*;i}", target="{i}")
path_mapper_2 = PathMapper(partition_list_3, source="{*;i}", target="{i}")
path_mapper_3 = PathMapper(partition_list_2, source="{*;i}", target="{i}")
surface_2 = Surface(flip_matrix)
geometry_2 = Geometry(path_mapper)

# ---- group: Extract correct pannel cut parts
deconstruct_5 = Deconstruct(Point=path_mapper_2)  # -> XComponent, YComponent, ZComponent
deconstruct_6 = Deconstruct(Point=path_mapper_3)  # -> XComponent, YComponent, ZComponent
# Only use in case of unexpected results
tolerance_2 = Slider(0.001, range=0..0.001)
sort_list = SortList(Keys=deconstruct_5.YComponent)  # -> reverse(Keys), ValuesA
sort_list_2 = SortList(Keys=deconstruct_5.XComponent)  # -> reverse(Keys), ValuesValuesA
list_item_2 = ListItem(List=sort_list_2.Keys, Index=0, Wrap=True)
list_item_3 = ListItem(List=sort_list.Keys, Index=0, Wrap=True)
addition_2 = Addition(A=list_item_2, B=tolerance_2)
addition_3 = Addition(A=list_item_3, B=tolerance_2)
smaller_than_2 = SmallerThan(FirstNumber=deconstruct_6.XComponent, SecondNumber=addition_2)  # -> SmallerThan, OrEqualTo
smaller_than_3 = SmallerThan(FirstNumber=deconstruct_6.YComponent, SecondNumber=addition_3)  # -> SmallerThan, OrEqualTo
gate_and_2 = GateAnd(A=smaller_than_2.SmallerThan, B=smaller_than_3.SmallerThan)
cull_pattern_2 = CullPattern(List=geometry_2, CullPattern=gate_and_2)
surface_3 = Surface(surface_2)
surface_4 = Surface(cull_pattern_2)
merge = Merge(Data1=surface_3, Data2=surface_4)

# ---- group: Generate window frames
# Sometimes windows extrude in wrong direction,
# try to use a negative parameter value.
brep_edges_2 = BrepEdges(Brep=merge)  # -> Naked, Interior, NonManifold
curve_middle = CurveMiddle(Curve=brep_edges_2.Naked)
join_curves_2 = JoinCurves(Curves=brep_edges_2.Naked, Preserve=False)  # -> simplify(Curves)
straight_offset = Slider(0, range=0..1)
evaluate_surface_2 = EvaluateSurface(Surface=reparameterize(join_curves_2), Point="0.5,0.5")  # -> Point, Normal, UDirection, VDirection, Frame
amplitude_2 = Amplitude(Vector=evaluate_surface_2.Normal, Amplitude=straight_offset)
deconstruct_7 = Deconstruct(Point=curve_middle)  # -> XComponent, YComponent, ZComponent
move = Move(Geometry=simplify(join_curves_2), Motion=amplitude_2)  # -> Geometry, Transform
sort_list_3 = SortList(Keys=deconstruct_7.ZComponent, ValuesValuesA=brep_edges_2.Naked)  # -> Keys, ValuesValuesA
list_item_4 = ListItem(List=sort_list_3.ValuesValuesA, Index=-1, Wrap=True)
angle = Slider(10, range=0..100)
rotate_axis = RotateAxis(Geometry=move.Geometry, Angle=degrees(angle), Axis=list_item_4)  # -> Geometry, Transform
angled_offset = Slider(0.1, range=0..1)
evaluate_surface_3 = EvaluateSurface(Surface=reparameterize(rotate_axis.Geometry), Point="0.5,0.5")  # -> Point, Normal, UDirection, VDirection, Frame
amplitude_3 = Amplitude(Vector=evaluate_surface_3.Normal, Amplitude=angled_offset)
frame_width_outer = Slider(0.1, range=0..1)
frame_width_inner = Slider(0.1, range=0..1)
move_2 = Move(Geometry=rotate_axis.Geometry, Motion=amplitude_3)  # -> Geometry, Transform
negative = Negative(Value=frame_width_outer)
negative_2 = Negative(Value=frame_width_inner)
offset_curve = OffsetCurve(Curve=move_2.Geometry, Distance=negative, Corners=1)
offset_curve_2 = OffsetCurve(Curve=join_curves_2, Distance=negative_2, Corners=1)

# ----
curve_2 = Curve(offset_curve_2)
curve_3 = Curve(move_2.Geometry)
# It is also possible to use intermediate curves
# from the last final script group. E.g. use the
# rotated curve instead of final output.
curve_4 = Curve(offset_curve)
# Use ruled surface to create frames.
curve_5 = Curve(join_curves_2)
ruled_surface = RuledSurface()
ruled_surface_2 = RuledSurface()
ruled_surface_3 = RuledSurface()
