# Grasshopper definition Input geometry for function selection.gh (Grasshopper 1.0.7)

# ----
# Parameters for tower 2
width_top_tower_1 = Slider(0.74, range=0.4..1.4)
width_top_tower_2 = Slider(0.52, range=0.25..1.25)
height_tower_2 = Slider(3, range=2.5..3.5)

length_top_tower_2 = Slider(0.52, range=0.25..1.25)
width_top_tower_1_2 = Slider(0.74, range=0.4..1.4)

# ----
# Should be changed to the input rectangles
panel = Panel("42")
rectangle = Rectangle(Plane=PlaneXY(0, 0, 0), XSize=panel, YSize=panel, Radius=0)  # -> Rectangle, Length
rectangle_2 = Rectangle(Plane=PlaneXY(0, 0, 0), XSize="42", YSize="42", Radius=0)  # -> Rectangle, Length

# ----
# Parameters for tower 1
width_intermediate_square = Slider(1.05, range=0.75..1.75)
length_intermediate_square = Slider(1.05, range=0.75..1.75)
height_intermediate_square = Slider(1.42, range=0.75..1.75)
height_tower_1 = Slider(2.84, range=1.5..3.5)
length_top = Slider(1.42, range=0.75..1.75)
width_top = Slider(1.42, range=0.75..1.75)

length_halfway = Slider(0.96, range=0.6..1.6)
width_halfway = Slider(0.96, range=0.6..1.6)

# ----
# Multiplication of parameters
number_slider = Slider(0, range=0..1)
deconstuct_rectangle = DeconstuctRectangle(Rectangle=[rectangle.Rectangle, rectangle_2.Rectangle])  # -> BasePlane, XInterval, YInterval
deconstruct_domain = DeconstructDomain(Domain=deconstuct_rectangle.YInterval)  # -> Start, End
list_item = ListItem(List=deconstruct_domain.End, Index=number_slider, Wrap=True)  # -> Item, Item1
multiplication = Multiplication(
    A=[width_intermediate_square, length_intermediate_square, height_intermediate_square, width_top, length_top, height_tower_1],
    B=list_item.Item)
list_item_2 = ListItem(List=[rectangle.Rectangle, rectangle_2.Rectangle], Index=number_slider, Wrap=True)  # -> Item, Item1
multiplication_2 = Multiplication(
    A=[width_halfway, length_halfway, width_top_tower_1, width_top_tower_1_2, width_top_tower_2, length_top_tower_2, height_tower_2],
    B=list_item.Item1)
panel_2 = Panel(multiplication)
panel_3 = Panel(multiplication_2)
list_item_3 = ListItem(List=multiplication, Index=0, Wrap=True)  # -> Item, Item1, Item2, Item3, Item4, Item5
list_item_4 = ListItem(List=multiplication_2, Index=0, Wrap=True)  # -> Item, Item1, Item2, Item3, Item4, Item5, Item6

# ----
# Constructing tower 2
discontinuity = Discontinuity(Curve=list_item_2.Item1, Level=1)  # -> Points, Parameters
rectangle_3 = Rectangle(list_item_2.Item1)
list_item_5 = ListItem(List=discontinuity.Points, Index=1, Wrap=True)
unit_z = UnitZ(Factor=list_item_3.Item5)
unit_z_2 = UnitZ(Factor=list_item_3.Item2)
unit_z_3 = UnitZ(Factor=list_item_4.Item6)
move = Move(Geometry=list_item_5, Motion=unit_z_2)  # -> Geometry, Transform
move_2 = Move(Geometry=list_item_5, Motion=unit_z)  # -> Geometry, Transform
negative = Negative(Value=list_item_4.Item3)
move_3 = Move(Geometry=list_item_5, Motion=unit_z_3)  # -> Geometry, Transform
negative_2 = Negative(Value=list_item_4.Item4)
negative_3 = Negative(Value=list_item_4.Item1)
rectangle_4 = Rectangle(Plane=move_2.Geometry, XSize=negative, YSize=list_item_4.Item2, Radius=0)  # -> Rectangle, Length
rectangle_5 = Rectangle(Plane=move_3.Geometry, XSize=negative_2, YSize=list_item_4.Item5, Radius=0)  # -> Rectangle, Length
rectangle_6 = Rectangle(Plane=move.Geometry, XSize=negative_3, YSize=list_item_4.Item, Radius=0)  # -> Rectangle, Length
discontinuity_2 = Discontinuity(Curve=rectangle_4.Rectangle, Level=1)  # -> simplify(graft(Points)), Parameters
discontinuity_3 = Discontinuity(Curve=rectangle_6.Rectangle, Level=1)  # -> simplify(graft(Points)), Parameters
discontinuity_4 = Discontinuity(Curve=rectangle_3, Level=1)  # -> simplify(graft(Points)), Parameters
discontinuity_5 = Discontinuity(Curve=rectangle_5.Rectangle, Level=1)  # -> simplify(graft(Points)), Parameters
unit_z_4 = UnitZ(Factor=1)
interpolate_t = InterpolateT(
    Vertices=[discontinuity_4.Points, discontinuity_3.Points, discontinuity_2.Points, discontinuity_5.Points],
    TangentStart=unit_z_4,
    TangentEnd=Vector(0, 0, 0),
    KnotStyle=1)  # -> flatten(Curve), Length, Domain
graft_tree = GraftTree(Tree=interpolate_t.Curve, IncludeEmptyLists=True, IncludeNullItems=True)
shift_list = ShiftList(List=interpolate_t.Curve, Shift=1, Wrap=True)  # -> graft(List)
shift_paths = ShiftPaths(Data=shift_list, Offset=1)
loft = Loft(
    Curves=[graft_tree, shift_paths],
    Options={Adjust=False, Closed=False, LoftEnds=0, LoftSimp=0, LoftType=0, Rebuild=10, Refit=0.01})  # -> flatten(Loft)
unit_z_5 = UnitZ(Factor=1)
brep_join = BrepJoin(Breps=loft)  # -> Breps, Closed
line_sdl = LineSDL(Start=list_item_5, Direction=unit_z_5, Length=1)
cap_holes = CapHoles(Brep=brep_join.Breps)
rotate_axis = RotateAxis(Geometry=cap_holes, Angle=expr("x*180-180", degrees(number_slider)), Axis=line_sdl)  # -> Geometry, Transform

# ----
# Constructing tower 1
discontinuity_6 = Discontinuity(Curve=list_item_2.Item, Level=1)  # -> Points, Parameters
rectangle_7 = Rectangle(list_item_2.Item)
list_item_6 = ListItem(List=discontinuity_6.Points, Index=1, Wrap=True)
unit_z_6 = UnitZ(Factor=list_item_3.Item2)
unit_z_7 = UnitZ(Factor=list_item_3.Item5)
move_4 = Move(Geometry=list_item_6, Motion=unit_z_6)  # -> Geometry, Transform
move_5 = Move(Geometry=list_item_6, Motion=unit_z_7)  # -> Geometry, Transform
negative_4 = Negative(Value=list_item_3.Item4)
negative_5 = Negative(Value=list_item_3.Item1)
rectangle_8 = Rectangle(Plane=move_4.Geometry, XSize=negative_5, YSize=list_item_3.Item, Radius=0)  # -> Rectangle, Length
rectangle_9 = Rectangle(Plane=move_5.Geometry, XSize=negative_4, YSize=list_item_3.Item3, Radius=0)  # -> Rectangle, Length
discontinuity_7 = Discontinuity(Curve=rectangle_8.Rectangle, Level=1)  # -> simplify(graft(Points)), Parameters
discontinuity_8 = Discontinuity(Curve=rectangle_9.Rectangle, Level=1)  # -> simplify(graft(Points)), Parameters
discontinuity_9 = Discontinuity(Curve=rectangle_7, Level=1)  # -> simplify(graft(Points)), Parameters
unit_z_8 = UnitZ(Factor=1)
interpolate_t_2 = InterpolateT(
    Vertices=[discontinuity_9.Points, discontinuity_7.Points, discontinuity_8.Points],
    TangentStart=unit_z_8,
    TangentEnd=Vector(0, 0, 0),
    KnotStyle=1)  # -> flatten(Curve), Length, Domain
graft_tree_2 = GraftTree(Tree=interpolate_t_2.Curve, IncludeEmptyLists=True, IncludeNullItems=True)
shift_list_2 = ShiftList(List=interpolate_t_2.Curve, Shift=1, Wrap=True)  # -> graft(List)
shift_paths_2 = ShiftPaths(Data=shift_list_2, Offset=1)
loft_2 = Loft(
    Curves=[graft_tree_2, shift_paths_2],
    Options={Adjust=False, Closed=False, LoftEnds=0, LoftSimp=0, LoftType=0, Rebuild=10, Refit=0.01})  # -> flatten(Loft)
unit_z_9 = UnitZ(Factor=1)
brep_join_2 = BrepJoin(Breps=loft_2)  # -> Breps, Closed
line_sdl_2 = LineSDL(Start=list_item_6, Direction=unit_z_9, Length=1)
cap_holes_2 = CapHoles(Brep=brep_join_2.Breps)
rotate_axis_2 = RotateAxis(Geometry=cap_holes_2, Angle=expr("x*180", degrees(number_slider)), Axis=line_sdl_2)  # -> Geometry, Transform
