# Grasshopper definition Towers Honeybee.gh (Grasshopper 1.0.7)
# Copyright: Job de Vogel

balcony_depth = Slider(1.8, range=0..10)
core_y_size = Slider(15, range=0..100)
shell_offset = Slider(1.8, range=0..10)
levels = Slider(11, range=0..30)
levels_per_level = Slider(3, range=0..10)
level_height = Slider(4.2, range=0..10)
grid_size = Slider(3.6, range=0..10)
core_x_distance = Slider(10, range=0..100)
core_y_distance = Slider(10, range=0..100)
core_x_size = Slider(15, range=0..100)
balcony_type = BooleanToggle(False)
curve = Curve(<curve referenced from the Rhino model>)
ground_floor_rectangle = GetGeometry(curve, AtLeast=1, AtMost=1, DeleteInput=False, Filter=1073741828)

# ---- group: Move tower to origin
discontinuity = Discontinuity(Curve=ground_floor_rectangle, Level=1)  # -> Points, Parameters
list_item = ListItem(List=discontinuity.Points, Index=0, Wrap=True)  # -> Item, Item1
xy_plane = XYPlane(Origin=Point(0, 0, 0))
vector_2pt = Vector2Pt(PointA=xy_plane, PointB=list_item.Item, Unitize=False)  # -> Vector, Length
negative = Negative(Value=vector_2pt.Vector)
move = Move(Geometry=ground_floor_rectangle, Motion=negative)  # -> Geometry, Transform
discontinuity_2 = Discontinuity(Curve=move.Geometry, Level=1)  # -> Points, Parameters
list_item_2 = ListItem(List=discontinuity_2.Points, Index=0, Wrap=True)  # -> Item, Item1
vector_2pt_2 = Vector2Pt(PointA=list_item_2.Item, PointB=list_item_2.Item1, Unitize=False)  # -> Vector, Length
unit_x = UnitX(Factor=1)
unit_y = UnitY(Factor=1)
rotate_direction = RotateDirection(Geometry=move.Geometry, Center=Point(0, 0, 0), From=vector_2pt_2.Vector, To=unit_x)  # -> Geometry, Transform
discontinuity_3 = Discontinuity(Curve=rotate_direction.Geometry, Level=1)  # -> Points, Parameters
list_item_3 = ListItem(List=discontinuity_3.Points, Index=0, Wrap=True)
point = Point(list_item_3)
geometry = Geometry(rotate_direction.Geometry)

# ---- group: Core Rectangle
number = Number(core_y_distance)
number_2 = Number(core_x_distance)
core_x_distance_2 = GetNumber(number_2, AtLeast=1, AtMost=1, Maximum=1.797693135e+308, Minimum=-1.797693135e+308)
core_y_distance_2 = GetNumber(number, AtLeast=1, AtMost=1, Maximum=1.797693135e+308, Minimum=-1.797693135e+308)
number_3 = Number(core_x_size)
number_4 = Number(core_y_size)
core_x_size_2 = GetNumber(number_3, AtLeast=1, AtMost=1, Maximum=1.797693135e+308, Minimum=-1.797693135e+308)
core_y_size_2 = GetNumber(number_4, AtLeast=1, AtMost=1, Maximum=1.797693135e+308, Minimum=-1.797693135e+308)
unit_y_2 = UnitY(Factor=core_y_distance_2)
unit_x_2 = UnitX(Factor=core_x_distance_2)
rectangle = Rectangle(Plane=PlaneXY(0, 0, 0), XSize=core_x_size_2, YSize=core_y_size_2, Radius=0)  # -> Rectangle, Length
addition = Addition(A=unit_x_2, B=unit_y_2)
use_core_boolean_toggle = BooleanToggle(True)
move_2 = Move(Geometry=rectangle.Rectangle, Motion=addition)  # -> Geometry, Transform
use_core_boolean_toggle_2 = GetBoolean(use_core_boolean_toggle, AtLeast=1, AtMost=1, FalseValue="False", TrueValue="True")
stream_filter = StreamFilter(Gate=use_core_boolean_toggle_2, Stream1=move_2.Geometry)

# ----
offset_curve = OffsetCurve(Distance=1, Corners=1)
number_5 = Number(level_height)
level_height_2 = GetNumber(number_5, AtLeast=1, AtMost=1, Maximum=1.797693135e+308, Minimum=-1.797693135e+308)

# ---- group: Rectangles
deconstuct_rectangle = DeconstuctRectangle(Rectangle=geometry)  # -> BasePlane, XInterval, YInterval
number_6 = Number(balcony_depth)
integer = Integer(levels_per_level)
integer_2 = Integer(levels)
balcony_depth_2 = GetNumber(number_6, AtLeast=1, AtMost=1, Maximum=1.797693135e+308, Minimum=-1.797693135e+308)
levels_per_level_2 = GetNumber(integer, AtLeast=1, AtMost=1, Maximum=1.797693135e+308, Minimum=-1.797693135e+308)
levels_2 = GetNumber(integer_2, AtLeast=1, AtMost=1, Maximum=1.797693135e+308, Minimum=-1.797693135e+308)
deconstruct_domain = DeconstructDomain(Domain=deconstuct_rectangle.XInterval)  # -> Start, End
deconstruct_domain_2 = DeconstructDomain(Domain=deconstuct_rectangle.YInterval)  # -> Start, End
series = Series(Start=0, Step=balcony_depth_2, Count=levels_2)
repeat_data = RepeatData(Data=levels_per_level_2, Length=levels_2)
absolute = Absolute(Value=deconstruct_domain.Start)
absolute_2 = Absolute(Value=deconstruct_domain_2.Start)
replace_items = ReplaceItems(List=repeat_data, Item="2", Indices="0", Wrap=False)
addition_2 = Addition(A=absolute, B=deconstruct_domain.End)
addition_3 = Addition(A=absolute_2, B=deconstruct_domain_2.End)
stack_data = StackData(Data=series, Stack=replace_items)
xy_plane_2 = XYPlane(Origin=point)
subtraction = Subtraction(A=addition_2, B=stack_data)
subtraction_2 = Subtraction(A=addition_3, B=stack_data)
rectangle_2 = Rectangle(Plane=xy_plane_2, XSize=subtraction, YSize=subtraction_2, Radius=0)  # -> Rectangle, Length
list_length = ListLength(List=rectangle_2.Rectangle)
series_2 = Series(Start=level_height_2, Step=level_height_2, Count=list_length)
unit_z = UnitZ(Factor=series_2)
move_3 = Move(Geometry=xy_plane_2, Motion=unit_z)  # -> Geometry, Transform
move_4 = Move(Geometry=rectangle_2.Rectangle, Motion=unit_z)  # -> Geometry, Transform
plane = Plane(move_3.Geometry)
curve_2 = Curve(move_4.Geometry)

# ---- group: Floor Plan Check
number_7 = Number(grid_size)
grid_size_2 = GetNumber(number_7, AtLeast=1, AtMost=1, Maximum=1.797693135e+308, Minimum=-1.797693135e+308)
text = Text(addition_2)
text_2 = Text(addition_3)
number_8 = Number(text)
number_9 = Number(text_2)
modulus = Modulus(A=number_8, B=grid_size_2)
modulus_2 = Modulus(A=number_9, B=grid_size_2)
mass_addition = MassAddition(Input=[modulus_2, modulus])  # -> Result, PartialResults
larger_than = LargerThan(FirstNumber=mass_addition.Result, SecondNumber=0)  # -> LargerThan, OrEqualTo
stream_filter_2 = StreamFilter(
    Gate=larger_than.LargerThan,
    Stream0="Everything Okay",
    Stream1="WARNING: Ground Floor rectangle domain does not fit in grid size.")

# ---- group: RH_OUT:OUT
out = Panel(stream_filter_2)

# ---- group: Point Grid
deconstuct_rectangle_2 = DeconstuctRectangle(Rectangle=curve_2)  # -> BasePlane, XInterval, YInterval
deconstruct_domain_3 = DeconstructDomain(Domain=deconstuct_rectangle_2.XInterval)  # -> Start, End
deconstruct_domain_4 = DeconstructDomain(Domain=deconstuct_rectangle_2.YInterval)  # -> Start, End
absolute_3 = Absolute(Value=deconstruct_domain_3.Start)
absolute_4 = Absolute(Value=deconstruct_domain_4.Start)
addition_4 = Addition(A=absolute_3, B=deconstruct_domain_3.End)
addition_5 = Addition(A=absolute_4, B=deconstruct_domain_4.End)
text_3 = Text(addition_4)
text_4 = Text(addition_5)
grid_size_3 = Number(grid_size_2)
number_10 = Number(text_3)
number_11 = Number(text_4)
division = Division(A=number_10, B=grid_size_3)
division_2 = Division(A=number_11, B=grid_size_3)
round = Round(Number=division)  # -> Nearest, graft(Floor), Ceiling
round_2 = Round(Number=division_2)  # -> Nearest, graft(Floor), Ceiling
series_3 = Series(Start=0, Step=grid_size_3, Count=expr("x+1", round.Floor))
series_4 = Series(Start=0, Step=grid_size_3, Count=expr("x+1", round_2.Floor))
cross_reference = CrossReference(ListListA=series_3, ListListB=series_4, CrossMode=1)  # -> ListListA, ListListB
construct_point = ConstructPoint(XCoordinate=cross_reference.ListListA, YCoordinate=cross_reference.ListListB, ZCoordinate=0)  # -> simplify(Point)
move_5 = Move(Geometry=construct_point, Motion=graft(unit_z))  # -> simplify(Geometry), Transform

# ---- group: General Information
area = Area(Geometry=curve_2)  # -> Area, Centroid
mass_addition_2 = MassAddition(Input=area.Area)  # -> Result, PartialResults

# ---- group: General Information / RH_OUT:Area
area_2 = Panel(mass_addition_2.Result)

# ----
level_height_3 = Number(level_height_2)
unit_z_2 = UnitZ(Factor=level_height)
unit_z_3 = UnitZ(Factor=level_height)
unit_z_4 = UnitZ(Factor=level_height)
panel = Panel("""29
28""")

# ----
# Extract epw data
epw_url = Panel("https://energyplus-weather.s3.amazonaws.com/europe_wmo_region_6/NLD/NLD_Amsterdam.062400_IWEC/NLD_Amsterdam.062400_IWEC.zip")
go_to_epw_website = BooleanToggle(False)
epwmap = LBEPWmap(epw_map=go_to_epw_website)  # -> Output; plug-in component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
downloadepw = LBDownloadWeather(weather_URL=epw_url)  # -> epw_file, stat_file, ddy_file; plug-in component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
importepw = LBImportEPW(epw_file=downloadepw.epw_file)  # -> location, dry_bulb_temperature, dew_point_temperature, relative_humidity, wind_speed, wind_direction, direct_normal_rad, diffuse_horizontal_rad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; plug-in component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

panel_2 = Panel("""Model
Model2""")
tree_branch = TreeBranch(Path="{0}", MaintainPaths=True)
recipesettings = HBRecipeSettings(workers=Slider(12, range=0..100), reload_old=False)  # -> settings; plug-in component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

multiplication = Multiplication(A=list_length, B=level_height_2)
curve_3 = Curve(stream_filter)
unit_z_5 = UnitZ(Factor=multiplication)
extrude = Extrude(Base=curve_3, Direction=unit_z_5)
brep_plane = BrepPlane(Brep=extrude, Plane=plane)  # -> Curves, Points
cap_holes = CapHoles(Brep=extrude)
surface = Surface(curve_2)
surface_split = SurfaceSplit(Surface=graft(surface), Curves=brep_plane.Curves)  # -> simplify(Fragments)
cluster = Cluster(geometry=extrude, transform=rotate_direction.Transform, transform_3=move.Transform)
list_item_4 = ListItem(List=surface_split, Index=0, Wrap=True)
cluster_2 = Cluster(geometry=list_item_4, transform=rotate_direction.Transform, transform_3=move.Transform)

# ---- group: RH_OUT:Core
geometry_2 = Geometry(cluster)

# ---- group: RH_OUT:Floor Surfaces
surface_2 = Surface(cluster_2)

# ----
custom_preview = CustomPreview(Geometry=geometry_2, Material=ColourSwatch(SwatchColor=RGB(255, 255, 255)))
custom_preview_2 = CustomPreview(Geometry=surface_2, Material=ColourSwatch(SwatchColor=RGB(255, 255, 255)))

# ---- group: General Information / RH_OUT:Height
height = Panel(multiplication)

# ---- group: Point Grid Core Extraction
point_in_brep = PointInBrep(Brep=cap_holes, Point=move_5.Geometry, Strict=False)
cull_pattern = CullPattern(List=move_5.Geometry, CullPattern=invert(point_in_brep))
cluster_3 = Cluster(geometry=cull_pattern, transform=rotate_direction.Transform, transform_3=move.Transform)

# ---- group: Columns
unit_z_6 = UnitZ(Factor=1)
negative_2 = Negative(Value=unit_z_6)
line_sdl = LineSDL(Start=cull_pattern, Direction=negative_2, Length=level_height_3)  # -> flatten(Line)
join_curves = JoinCurves(Curves=line_sdl, Preserve=False)
cluster_4 = Cluster(geometry=join_curves, transform=rotate_direction.Transform, transform_3=move.Transform)

# ---- group: Point Grid Core Extraction / RH_OUT:Points
point_2 = Point(cluster_3)

# ----
cluster_5 = Cluster(geometry=join_curves, transform=rotate_direction.Transform, transform_3=move.Transform)

# ---- group: Columns / RH_OUT:Columns
curve_4 = Curve(cluster_4)

# ---- group: Shell
partition_list = PartitionList(List=curve_2, Size=replace_items)
number_12 = Number(shell_offset)
shell_offset_2 = GetNumber(number_12, AtLeast=1, AtMost=1, Maximum=1.797693135e+308, Minimum=-1.797693135e+308)
list_item_5 = ListItem(List=partition_list, Index=-1, Wrap=True)  # -> simplify(Item)
offset_curve_2 = OffsetCurve(Curve=list_item_5, Distance=shell_offset_2, Corners=1)  # -> flatten(Curve)
loft = Loft(Curves=offset_curve_2, Options={Adjust=False, Closed=False, LoftEnds=0, LoftSimp=0, LoftType=0, Rebuild=10, Refit=0.01})
cluster_6 = Cluster(geometry=loft, transform=rotate_direction.Transform, transform_3=move.Transform)

# ---- group: Shell / RH_OUT:Outer Shell
geometry_3 = Geometry(cluster_6)

# ----
cluster_7 = Cluster(geometry=curve_2, transform=rotate_direction.Transform, transform_3=move.Transform)
mesh_brep = MeshBrep(
    Brep=geometry_3,
    Settings={GridMaxCount=0, GridMinCount=16, JaggedSeams=False, MaxEdgeLength=0, MinEdgeLength=0.0001, MinTolerance=0, Refine=True, RefineAngle=0, RelativeTolerance=0.65, SimplePlanes=True, Tolerance=0})
number_13 = Number(balcony_depth)
mesh_plane = MeshPlane(Mesh=mesh_brep, Plane=cluster_7)  # -> simplify(Curves)
offset_curve_3 = OffsetCurve(Curve=cluster_7, Distance=flatten(number_13), Corners=1)
discontinuity_4 = Discontinuity(Curve=cluster_7, Level=1)  # -> simplify(Points), Parameters
discontinuity_5 = Discontinuity(Curve=mesh_plane, Level=1)  # -> simplify(Points), Parameters
merge = Merge(Data1=graft(cluster_7), Data2=offset_curve_3)
closest_point = ClosestPoint(Point=discontinuity_4.Points, Cloud=discontinuity_5.Points)  # -> ClosestPoint, CPIndex, Distance
loft_2 = Loft(Curves=merge, Options={Adjust=False, Closed=False, LoftEnds=0, LoftSimp=0, LoftType=0, Rebuild=10, Refit=0.01})
clean_tree = CleanTree(RemoveNulls=True, RemoveInvalid=True, RemoveEmpty=False, Tree=closest_point.ClosestPoint)
tree_statistics = TreeStatistics(Tree=clean_tree)  # -> Paths, Length, Count
larger_than_2 = LargerThan(FirstNumber=tree_statistics.Length, SecondNumber=0)  # -> LargerThan, OrEqualTo
cull_pattern_2 = CullPattern(List=tree_statistics.Paths, CullPattern=larger_than_2.LargerThan)
tree_branch_2 = TreeBranch(Tree=discontinuity_4.Points, Path=cull_pattern_2, MaintainPaths=True)
tree_branch_3 = TreeBranch(Tree=closest_point.ClosestPoint, Path=cull_pattern_2, MaintainPaths=True)
tree_branch_4 = TreeBranch(Tree=simplify(loft_2), Path=cull_pattern_2, MaintainPaths=True)  # -> flatten(Branch)
polyline = PolyLine(Vertices=tree_branch_3, Closed=True)
polyline_2 = PolyLine(Vertices=tree_branch_2, Closed=True)
loft_3 = Loft(
    Curves=[polyline, polyline_2],
    Options={Adjust=False, Closed=False, LoftEnds=0, LoftSimp=0, LoftType=0, Rebuild=10, Refit=0.01})
boolean = Boolean(balcony_type)
balconies_bool = GetBoolean(boolean, AtLeast=1, AtMost=1, FalseValue="False", TrueValue="True")
stream_filter_3 = StreamFilter(Gate=balconies_bool, Stream0=flatten(loft_3), Stream1=tree_branch_4)

# ---- group: Shell (continued)
custom_preview_3 = CustomPreview(Geometry=geometry_3, Material=ColourSwatch(SwatchColor=RGBA(255, 255, 255, 153)))

# ---- group: RH_OUT:Balconies
geometry_4 = Geometry(stream_filter_3)

# ----
move_6 = Move(Geometry=geometry_4, Motion=unit_z_2)  # -> Geometry, Transform
move_7 = Move(Geometry=polyline_2, Motion=unit_z_3)  # -> Geometry, Transform
move_8 = Move(Geometry=polyline, Motion=unit_z_4)  # -> Geometry, Transform
loft_4 = Loft(
    Curves=[polyline_2, move_7.Geometry],
    Options={Adjust=False, Closed=False, LoftEnds=0, LoftSimp=0, LoftType=0, Rebuild=10, Refit=0.01})  # -> flatten(Loft)
loft_5 = Loft(
    Curves=[polyline, move_8.Geometry],
    Options={Adjust=False, Closed=False, LoftEnds=0, LoftSimp=0, LoftType=0, Rebuild=10, Refit=0.01})  # -> flatten(Loft)
deconstruct_brep = DeconstructBrep(Brep=graft(loft_5))  # -> Faces, Edges, Vertices
deconstruct_brep_2 = DeconstructBrep(Brep=deconstruct_brep.Faces)  # -> Faces, Edges, Vertices
join_curves_2 = JoinCurves(Curves=deconstruct_brep_2.Edges, Preserve=False)
trim_tree = TrimTree(Tree=join_curves_2, Depth=2)
offset_on_srf = OffsetOnSrf(Curve=trim_tree, Distance=Slider(0.1, range=0..1), Surface=deconstruct_brep.Faces)
list_item_6 = ListItem(List=reverse(geometry_4), Index=0, Wrap=True)  # -> Item, Item1
trim_tree_2 = TrimTree(Tree=offset_on_srf, Depth=2)
list_item_7 = ListItem(List=reverse([geometry_4, move_6.Geometry]), Index=0, Wrap=True)  # -> Item, Item1
list_item_8 = ListItem(List=reverse(loft_4), Index=0, Wrap=True)  # -> Item, Item1
list_item_9 = ListItem(List=reverse(loft_5), Index=0, Wrap=True)  # -> Item, Item1
surface_3 = Surface(simplify(trim_tree_2))
graft_tree = GraftTree(Tree=[list_item_8.Item, list_item_8.Item1], IncludeEmptyLists=True, IncludeNullItems=True)
graft_tree_2 = GraftTree(Tree=[list_item_9.Item, list_item_9.Item1], IncludeEmptyLists=True, IncludeNullItems=True)
graft_tree_3 = GraftTree(Tree=[list_item_7.Item, list_item_7.Item1], IncludeEmptyLists=True, IncludeNullItems=True)
graft_tree_4 = GraftTree(Tree=[list_item_6.Item, list_item_6.Item1], IncludeEmptyLists=True, IncludeNullItems=True)
tree_branch_5 = TreeBranch(Tree=simplify(surface_3), Path=panel, MaintainPaths=False)

# ----
# Create honeybee elements
panel_3 = Panel("RoofCeiling")
window = Geometry(tree_branch_5)
aperture = HBAperture(geo=tree_branch_5, operable="True")  # -> out, apertures; plug-in component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
face = HBFace(geo=graft_tree_4, type="Floor", bc="Ground")  # -> out, simplify(faces); plug-in component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
face_2 = HBFace(geo=graft_tree_3, type=panel_3, bc="Outdoors")  # -> out, simplify(faces); plug-in component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
face_3 = HBFace(geo=graft_tree_2, type="Wall", bc="Outdoors")  # -> out, faces; plug-in component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

face_4 = HBFace(geo=graft_tree, type="Wall", bc="Adiabatic")  # -> out, simplify(faces); plug-in component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

# ----
# Create honeybee model
number_slider = Slider(0.1, range=0..1)
addshade = HBAddShade(hb_obj=aperture.apertures)  # -> hb_obj; plug-in component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
addsubface = HBAddSubface(hb_obj=simplify(face_3.faces), sub_faces=addshade)  # -> simplify(hb_obj); plug-in component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
panel_4 = Panel("""Room
Room2""")
bordershades = HBExtrudedBorderShades(hb_objs=aperture.apertures, depth=number_slider, indoor="True")  # -> out, simplify(hb_objs); plug-in component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
room = HBRoom(faces=[face.faces, face_2.faces, addsubface, face_4.faces], name=simplify(graft(panel_4)), conditioned=True)  # -> out, room; plug-in component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
model = HBModel(rooms=room.room, apertures=bordershades.hb_objs, name=simplify(graft(panel_2)))  # -> out, model; plug-in component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

# ----
# Create grid size
height_to_analyse = Slider(0, range=0..1)
gridsize = Slider(1, range=0..15)
gridrooms = HBSensorGridFromRooms(rooms=model.model, grid_size=gridsize, dist_floor=height_to_analyse)  # -> grid, points, mesh; plug-in component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
assigngridsviews = HBAssignGridsAndViews(model=model.model, grids=gridrooms.grid)  # -> model; plug-in component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

deconstruct_mesh = DeconstructMesh(Mesh=gridrooms.mesh)  # -> Vertices, Faces, Colours, Normals
list_length_2 = ListLength(List=deconstruct_mesh.Faces)  # -> flatten(Length)
list_item_10 = ListItem(List=list_length_2, Index=0, Wrap=True)
panel_5 = Panel(list_item_10)

# ----
# Annual sunlight analysis
# Run analysis!
wea = HBWeaFromEPW(epw_file=downloadepw.epw_file)  # -> wea; plug-in component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
unit_y_3 = UnitY(Factor=1)
directsunhours = HBDirectSunHours(model=simplify(assigngridsviews), wea=wea, north=unit_y_3, run_settings=recipesettings, run=Toggle(False))  # -> out, results, hours; plug-in component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

panel_6 = Panel(directsunhours.hours)
data_recorder = DataRecorder(directsunhours.hours, DataLimit=2000, RecordData=True)

# ----
# Point in time analysis
# Run analysis!
hour = Slider(13, range=0..24)
month = Slider(3, range=0..12)
day = Slider(12, range=0..31)
unit_y_4 = UnitY(Factor=1)
ciesky = HBCIEStandardSky(north=unit_y_4, location=importepw.location, month=month, day=day, hour=hour, type=Slider(0, range=0..100))  # -> sky; plug-in component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
radpar = HBRadianceParameter(recipe_type=Slider(0, range=0..2), detail_level=Slider(1, range=0..10))  # -> rad_par; plug-in component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
pitgrid = HBPointInTimeGridBased(model=assigngridsviews, sky=ciesky, metric=Slider(1, range=0..1), radiance_par=radpar, run=Toggle(False))  # -> out, results; plug-in component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

split_list = SplitList(List=pitgrid.results, Index=list_item_10)  # -> ListA, ListB
entwine = Entwine(Branch00=split_list.ListA, Branch01=split_list.ListB, FlattenInputs=True)  # -> simplify(Result)

heatmap = LBSpatialHeatmap(values=simplify(entwine), mesh=simplify(gridrooms.mesh))  # -> mesh, legend, title, colors, legend_par; plug-in component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

heatmap_2 = LBSpatialHeatmap(values=simplify(entwine), mesh=simplify(gridrooms.mesh))  # -> mesh, legend, title, colors, legend_par; plug-in component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

mesh = Mesh(heatmap_2.mesh)

# ==== cluster Cluster
transform = ClusterInput()
inverse_transform = InverseTransform(Transform=transform)
geometry = ClusterInput()
transform_2 = Transform(Geometry=geometry, Transform=inverse_transform)
transform_3 = ClusterInput()
inverse_transform_2 = InverseTransform(Transform=transform_3)
transform_4 = Transform(Geometry=transform_2, Transform=inverse_transform_2)
geometry_2 = ClusterOutput(transform_4)
