# Grasshopper definition main.gh (Grasshopper 1.0.7)
# Copyright: Job de Vogel
# plug-ins: Hops

curve_center_grid = Slider(0.586, range=0..1)
water_offset = Slider(107, range=0..150)
north_border = Slider(0.888, range=0..1)
south_border = Slider(0.034, range=0..1)
dike_offset = Slider(50, range=0..100)
dike_cut_size = Slider(50, range=-50..75)
z_grid_size = Slider(6, range=0..10)
grid_size_x = Slider(12, range=0..12)
grid_size_y = Slider(24, range=0..24)
x_size_grid = Slider(175, range=0..175)
y_size_grid = Slider(300, range=0..300)
distribution_height = Slider(12, range=0..100)

column_radius = Slider(0.8, range=0..1)
curve = Curve(<curve referenced from the Rhino model>)
# main_base.gh
hops = Hops(
    WaterOutline=curve,
    CurveCenterGrid=0.516,
    WaterOffset=99,
    NorthBorder=0.919,
    SouthBorder=0.034,
    DikeOffset=50,
    DikeCutSize=50,
    GridSizeX=12,
    GridSizeY=24,
    XSizeGrid=175,
    YSizeGrid=300,
    DistributionHeight=12,
    ZGridSize=6,
    ColumnRadius=column_radius,
    CacheResultsInMemory=True,
    CacheSolveResults=True,
    RemoteDefinitionLocation="C:\Users\Job de Vogel\OneDrive\Documenten\TU Delft\Building Technology\MEGA\Grasshopper Files\main_base.gh",
    RemoteSolveVersion=(0, 1, 0),
    ShowInput_Enabled=False,
    ShowInput_Path=False,
    SynchronousSolve=False)  # -> ColumnCurves, Pointgrid, Columns, InnerWall, OuterWall, Dike

balcony_type = BooleanToggle(False)
grid_size = Slider(7.2, range=0..10)
shell_offset = Slider(1.8, range=0..10)
# COPY TOP SCRIPT TOWER TO BOTTOM
balcony_depth = Slider(0.6, range=0..10)
levels = Slider(37, range=0..40)
levels_per_level = Slider(1, range=0..10)
level_height = Slider(3.8, range=0..10)
core_x_distance = Slider(10, range=0..100)
core_y_distance = Slider(10, range=0..100)
core_x_size = Slider(15, range=0..100)
core_y_size = Slider(15, range=0..100)

# ----
# main_towers.gh
curve_2 = Curve(<curve referenced from the Rhino model>)
core_corner = Slider(0, range=0..3)
x_size_small_core = Slider(9, range=0..15)
y_size_small_core = Slider(10, range=0..15)
core_split_level = Slider(20, range=0..30)

truss_1_height = Slider(22, range=0..30)
facade_truss_x_width = Slider(6.9, range=0..10)
facade_truss_y_width = Slider(8.1, range=0..10)
truss_x_grid_distance = Slider(7.2, range=0..10)
truss_2_height = Slider(16, range=0..30)
truss_height = Slider(4.2, range=0..8.4)
truss_count_center = Slider(3, range=0..10)
truss_count_endings = Slider(2, range=0..10)

boolean_toggle = BooleanToggle(True)

grid_size_2 = Slider(7.2, range=0..10)
core_x_size_2 = Slider(15, range=0..100)
shell_offset_2 = Slider(1.8, range=0..10)
balcony_depth_2 = Slider(0.6, range=0..10)
levels_2 = Slider(37, range=0..40)
levels_per_level_2 = Slider(1, range=0..10)
level_height_2 = Slider(3.8, range=0..10)
core_x_distance_2 = Slider(10, range=0..100)
core_y_distance_2 = Slider(10, range=0..100)
core_y_size_2 = Slider(15, range=0..100)
balcony_type_2 = BooleanToggle(False)

curve_3 = Curve(<curve referenced from the Rhino model>)
core_corner_2 = Slider(0, range=0..3)
x_size_small_core_2 = Slider(9, range=0..15)
y_size_small_core_2 = Slider(10, range=0..15)
core_split_level_2 = Slider(20, range=0..30)
# main_towers.gh
hops_2 = Hops(
    GroundFloorRectangle=curve_3,
    ShellOffset=shell_offset_2,
    BalconyDepth=balcony_depth_2,
    Levels=levels_2,
    LevelsPerLevel=levels_per_level_2,
    AmountOfBaseFloors=3,
    LevelHeight=level_height_2,
    GridSize=grid_size_2,
    StartGridOffset=0,
    CoreXDistance=core_x_distance_2,
    CoreYDistance=core_y_distance_2,
    CoreXSize=core_x_size_2,
    CoreYSize=core_y_size_2,
    BalconiesBool=balcony_type_2,
    CoreCorner=core_corner_2,
    XSizeSmallCore=x_size_small_core_2,
    YSizeSmallCore=y_size_small_core_2,
    CoreSplitLevel=core_split_level_2,
    UseCoreBooleanToggle=Toggle(True),
    CacheResultsInMemory=True,
    CacheSolveResults=True,
    RemoteDefinitionLocation="C:\Users\Job de Vogel\OneDrive\Documenten\TU Delft\Building Technology\MEGA\Grasshopper Files\main_towers.gh",
    RemoteSolveVersion=(0, 1, 0),
    ShowInput_Enabled=False,
    ShowInput_Path=False,
    SynchronousSolve=False)  # -> InnerFacade, Balconies, OuterShell, Columns, Points, FloorSurfaces, CoreMesh, STRUCTURALOUTPUTS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
data_dam = DataDam(BufferDelay=10000000, BufferMode=0)
merge = Merge()

facade_truss_y_width_2 = Slider(8.1, range=0..10)
truss_x_grid_distance_2 = Slider(7.2, range=0..10)
truss_1_height_2 = Slider(30, range=0..30)
truss_2_height_2 = Slider(16, range=0..30)
facade_truss_x_width_2 = Slider(6.9, range=0..10)
truss_height_2 = Slider(4.2, range=0..8.4)
truss_count_center_2 = Slider(3, range=0..10)
truss_count_endings_2 = Slider(2, range=0..10)

# ----
# main_structure.gh
tolerance = Slider(0.001, range=0..0.001)
v_panel_height = Slider(3.8, range=0..10)
angle = Slider(10, range=0..100)
straight_offset = Slider(0, range=0..1)
angled_offset = Slider(0.1, range=0..1)
frame_width_inner = Slider(0.1, range=0..1)
frame_width_outer = Slider(0.1, range=0..1)
u_panel_width = Slider(1.2, range=0..10)

# ---- group: Generate Facade
data_dam_2 = DataDam(BufferDelay=10000000, BufferMode=0)

# ----
data_dam_3 = DataDam(DataDataA=hops_2.OuterShell, BufferDelay=10000000, BufferMode=0)
construct_matrix = ConstructMatrix(Rows="4", Columns="4")
merge_2 = Merge(
    Data1=hops_2.InnerFacade,
    Data2=hops_2.Balconies,
    Data3=hops_2.Columns,
    Data4=hops_2.Points,
    Data5=hops_2.FloorSurfaces,
    Data6=hops_2.CoreMesh)
# main_structure.gh
hops_3 = Hops(
    OuterShell=data_dam_3,
    CoreSplitLevel=core_split_level_2,
    CoreOuterRectangles=hops_2.CoreOuterRectangles,
    CoreInnerRectangles=hops_2.CoreInnerRectangles,
    FloorOuterRectangles=hops_2.FloorOuterRectangles,
    FloorPlanes=hops_2.FloorPlanes,
    GroundFloorLevelException=hops_2.GroundFloorLevelException,
    FacadeTrussXWidth=facade_truss_x_width_2,
    FacadeTrussYWidth=facade_truss_y_width_2,
    TrussXGridDistance=truss_x_grid_distance_2,
    Truss1Height=truss_1_height_2,
    Truss2Height=truss_2_height_2,
    TrussHeight=truss_height_2,
    TrussCountCenter=truss_count_center_2,
    TrussCountEndings=truss_count_endings_2,
    CacheResultsInMemory=True,
    CacheSolveResults=True,
    RemoteDefinitionLocation="C:\Users\Job de Vogel\OneDrive\Documenten\TU Delft\Building Technology\MEGA\Grasshopper Files\main_structure.gh",
    RemoteSolveVersion=(0, 1, 0),
    ShowInput_Enabled=False,
    ShowInput_Path=False,
    SynchronousSolve=True)  # -> Diagonal1, Diagonal2, Vertical, HorizontalTop, HorizontalBottom, FacadeHorizontalTop, FacadeVertical, FacadeDiagonals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
# main_facade.gh
negative = Negative(Value=angle)
negative_2 = Negative(Value=straight_offset)
negative_3 = Negative(Value=angled_offset)
merge_3 = Merge()

v_panel_height_2 = Slider(3.8, range=0..10)
u_panel_width_2 = Slider(1.8, range=0..10)
angle_2 = Slider(10, range=0..100)
straight_offset_2 = Slider(0, range=0..1)
angled_offset_2 = Slider(0.1, range=0..1)
frame_width_inner_2 = Slider(0.1, range=0..1)
frame_width_outer_2 = Slider(0.1, range=0..1)
tolerance_2 = Slider(0.001, range=0..0.001)

# ---- group: Generate Facade
data_dam_4 = DataDam(DataDataA=hops_2.OuterShell, BufferDelay=10000000, BufferMode=0)

# ----
construct_matrix_2 = ConstructMatrix(Rows="4", Columns="4", Values=hops_2._4x4InversedTransform)
negative_4 = Negative(Value=angle_2)
negative_5 = Negative(Value=straight_offset_2)
negative_6 = Negative(Value=angled_offset_2)
merge_4 = Merge(
    Data1=hops_3.Diagonal1,
    Data2=hops_3.Diagonal2,
    Data3=hops_3.Vertical,
    Data4=hops_3.HorizontalTop,
    Data5=hops_3.HorizontalBottom,
    Data6=hops_3.FacadeHorizontalTop,
    Data7=hops_3.FacadeVertical,
    Data8=hops_3.FacadeDiagonals,
    Data9=hops_3.FacadeHorizontalBottom,
    Data10=hops_3.TopFacadeColumns,
    Data11=hops_3.BottomFacadeColumns)
# main_facade.gh
hops_4 = Hops(
    ShellBrep=data_dam_4,
    VPanelHeight=v_panel_height_2,
    UPanelWidth=u_panel_width_2,
    AngleDegrees=negative_4,
    NormalOffset=negative_5,
    AngledOffset=negative_6,
    FrameWidthInner=frame_width_inner_2,
    FrameWidthOuter=frame_width_outer_2,
    Tolerance=tolerance_2,
    CacheResultsInMemory=True,
    CacheSolveResults=True,
    RemoteDefinitionLocation="C:\Users\Job de Vogel\OneDrive\Documenten\TU Delft\Building Technology\MEGA\Grasshopper Files\main_facade.gh",
    RemoteSolveVersion=(0, 1, 0),
    ShowInput_Enabled=False,
    ShowInput_Path=False,
    SynchronousSolve=False)  # -> OuterFrameInside, InnerFrameInside, InnerFrameOutside, StraightOffsetOuterFrame, AngledOffsetOuterFrame
merge_5 = Merge()
transform = Transform(Geometry=merge, Transform=construct_matrix)
transform_2 = Transform(Geometry=merge_5, Transform=construct_matrix)
transform_3 = Transform(Geometry=merge_3, Transform=construct_matrix)
merge_6 = Merge(
    Data1=hops_4.OuterFrameInside,
    Data2=hops_4.InnerFrameInside,
    Data3=hops_4.InnerFrameOutside,
    Data4=hops_4.StraightOffsetOuterFrame,
    Data5=hops_4.AngledOffsetOuterFrame)
geometry = Geometry(transform_3)
geometry_2 = Geometry(transform)
geometry_3 = Geometry(transform_2)
transform_4 = Transform(Geometry=merge_2, Transform=construct_matrix_2)
transform_5 = Transform(Geometry=merge_6, Transform=construct_matrix_2)
transform_6 = Transform(Geometry=merge_4, Transform=construct_matrix_2)
geometry_4 = Geometry(transform_5)
geometry_5 = Geometry(transform_4)
geometry_6 = Geometry(transform_6)
