# Grasshopper definition test.gh (Grasshopper 1.0.7)
# Copyright: Job de Vogel

geometry = Geometry(<curve referenced from the Rhino model>)
get_geometry = GetGeometry(geometry, AtLeast=1, AtMost=1, DeleteInput=False, Filter=1074004029)
get_number = GetNumber(Slider(5, range=0..10), AtLeast=1, AtMost=1, Maximum=1.797693135e+308, Minimum=-1.797693135e+308)
divide_curve = DivideCurve(Curve=get_geometry, Count=get_number, Kinks=False)  # -> Points, Tangents, Parameters

# ---- group: RH_OUT:YOOO
point = Point(divide_curve.Points)
